# Grasshopper definition December25th2019.gh (Grasshopper 0.9.80)
# plug-ins: Bifocals

number_slider = Slider(4, range=1..14)
rectangle = Rectangle(Plane=PlaneXY(0, 0, 0), XSize=number_slider, YSize=number_slider, Radius=0)  # -> Rectangle, Length
boundary_surfaces = BoundarySurfaces(Edges=rectangle.Rectangle)
divide_surface = DivideSurface(Surface=boundary_surfaces, UCount=10, VCount=10)  # -> Points, Normals, Parameters
construct_domain = ConstructDomain(DomainStart=Slider(0.46, range=0..1), DomainEnd=Slider(10, range=0..10))
list_length = ListLength(List=divide_surface.Points)
range = Range(Domain=construct_domain, Steps=expr("x-1", list_length))  # -> flatten(Range)
jitter = Jitter(List=range, Jitter=1, Seed=2)  # -> Values, Indices
construct_domain_2 = ConstructDomain(DomainStart=0, DomainEnd=1)
unit_z = UnitZ(Factor=jitter.Values)
range_2 = Range(Domain=construct_domain_2, Steps=10)
move = Move(Geometry=graft(divide_surface.Points), Motion=graft(unit_z))  # -> flatten(Geometry), Transform
surface_from_points = SurfaceFromPoints(Points=move.Geometry, UCount=list_length, Interpolate=False)
construct_point = ConstructPoint(XCoordinate=graft(range_2), YCoordinate=range_2, ZCoordinate=0)
evaluate_surface = EvaluateSurface(Surface=reparameterize(flatten(surface_from_points)), Point=flatten(construct_point))  # -> Point, Normal, Frame
move_2 = Move(Geometry=evaluate_surface.Point, Motion=evaluate_surface.Normal)  # -> Geometry, Transform
surface_from_points_2 = SurfaceFromPoints(Points=move_2.Geometry, UCount=list_length, Interpolate=False)
