# Grasshopper definition January10tth2020TedeschiChapter001Advanced.gh (Grasshopper 1.0.7)
# plug-ins: Bifocals, LunchBox

number_slider = Slider(40, range=0..210)
srf = Surface(reparameterize(<surface referenced from the Rhino model>))
trib = TrianglePanelsB(Surface=srf, UDivisions=number_slider, VDivisions=number_slider)
area = Area(Geometry=trib)  # -> Area, Centroid
debrep = DeconstructBrep(Brep=trib)  # -> Faces, Edges, Vertices
srf_cp = SurfaceClosestPoint(Point=area.Centroid, Surface=srf)  # -> Point, UVPoint, Distance
crv = Curve(debrep.Edges)
evalsrf = EvaluateSurface(Surface=srf, Point=srf_cp.UVPoint)  # -> Point, Normal, UDirection, VDirection, Frame
curvepoint = PointOnCurve(crv, parameter=0.5)
multiplication = Multiplication(A=evalsrf.Normal, B=Slider(2.99, range=0..40))
move = Move(Geometry=area.Centroid, Motion=multiplication)  # -> Geometry, Transform
image = ImageSampler(
    srf_cp.UVPoint,
    FilePath="C:\Users\Sculpture\Desktop\ScreenShots2019\BlackandWhiteOscar.PNG",
    Filter="Value",
    Interpolate=False,
    Umax=1,
    Umin=0,
    Vmax=1,
    Vmin=0,
    Wrap=1)
ln = Line(StartPoint=graft(move.Geometry), EndPoint=curvepoint)
neg = Negative(Value=Slider(0.92, range=0..1))
dom = ConstructDomain(DomainStart=neg, DomainEnd=Slider(0.27, range=0..1))
bnd = Bounds(Numbers=image)
pt = Point(move.Geometry)
number_slider_2 = Slider(2, range=0..10)
remap = RemapNumbers(Value=image, Source=bnd, Target=dom)  # -> Mapped, Clipped
ln_2 = Line(StartPoint=graft(pt), EndPoint=debrep.Vertices)
graft = GraftTree(Tree=remap.Mapped, IncludeEmptyLists=True, IncludeNullItems=True)
eval = EvaluateCurve(Curve=ln, Parameter=graft)  # -> Point, Tangent, Angle
ln_3 = Line(StartPoint=graft(pt), EndPoint=eval.Point)
shift = ShiftList(List=ln_2, Shift=number_slider_2, Wrap=True)
shift_2 = ShiftList(List=ln_3, Shift=number_slider_2, Wrap=True)
merge = Merge(Data1=graft(shift_2), Data2=graft(shift))
merge_2 = Merge(Data1=graft(ln_3), Data2=graft(ln_2))
loft = Loft(Curves=merge, Options={Adjust=False, Closed=False, LoftEnds=0, LoftSimp=0, LoftType=0, Rebuild=10, Refit=0.01})
loft_2 = Loft(Curves=merge_2, Options={Adjust=False, Closed=False, LoftEnds=0, LoftSimp=0, LoftType=0, Rebuild=10, Refit=0.01})
