# Grasshopper definition January10tth2020TedeschiChapter002Advanced.gh (Grasshopper 1.0.7)
# plug-ins: HoopSnake, Bifocals

number_slider = Slider(24, range=0..100)
rectangle = Rectangle(Plane=PlaneXY(0, 0, 0), XSize=number_slider, YSize=number_slider, Radius=0)  # -> Rectangle, Length
explode = Explode(Curve=rectangle.Rectangle, Recursive=True)  # -> reverse(Segments), Vertices
crv = Curve(explode.Segments)

# ----
# Trim with crv in Rhino (circle, centered)
number_slider_2 = Slider(1, range=0..1)
number_slider_3 = Slider(30, range=0..100)
crv_2 = Curve(reparameterize(<curve referenced from the Rhino model>))

curvepoint = PointOnCurve(hs.Feedback, parameter=0.25)
shift = ShiftList(List=curvepoint, Shift=Slider(1, range=0..4), Wrap=True)
curvepoint_2 = PointOnCurve(hs.Feedback, parameter=0.5)
ln = Line(StartPoint=curvepoint_2, EndPoint=shift)
item = ListItem(List=ln, Index=Slider(0, range=0..100), Wrap=True)
item_2 = ListItem(List=ln, Index=Slider(1, range=0..100), Wrap=True)
item_3 = ListItem(List=ln, Index=Slider(2, range=0..100), Wrap=True)
item_4 = ListItem(List=ln, Index=Slider(3, range=0..100), Wrap=True)
llx = LineLine(Line1=item, Line2=item_4)  # -> ParamA, ParamB, PointA, PointB
llx_2 = LineLine(Line1=item, Line2=item_2)  # -> ParamA, ParamB, PointA, PointB
llx_3 = LineLine(Line1=item_2, Line2=item_3)  # -> ParamA, ParamB, PointA, PointB
llx_4 = LineLine(Line1=item_3, Line2=item_4)  # -> ParamA, ParamB, PointA, PointB
merge = Merge(Data1=llx.PointA, Data2=llx_2.PointA, Data3=llx_3.PointA, Data4=llx_4.PointA)  # -> flatten(Result)
pline = PolyLine(Vertices=merge, Closed=Toggle(True))
explode_2 = Explode(Curve=pline, Recursive=True)  # -> Segments, Vertices
flip = FlipMatrix(Data=explode_2.Segments)

hs = HoopSnake(
    StartingData=crv,
    Data=flip,
    TerminationCondition=Slider(5, range=0..10),
    Hoopsnake_Data_autoUpdate=False,
    Hoopsnake_Data_dataLimit=2147483647,
    Hoopsnake_Data_resetCounter=True,
    Hoopsnake_Data_updateView=True)  # -> Feedback, FeedbackHistory, LoopsCounter, IterationsCounter

bang = ExplodeTree(Data=simplify(hs.FeedbackHistory))  # -> Branch0, Branch1, Branch2, Branch3, Branch4, Branch5

curvepoint_3 = PointOnCurve(bang.Branch0, parameter=0.675)
curvepoint_4 = PointOnCurve(bang.Branch0, parameter=0.5)
shift_2 = ShiftList(List=curvepoint_4, Shift=1, Wrap=True)
ln_2 = Line(StartPoint=curvepoint_3, EndPoint=shift_2)
mcx = MultipleCurves(Curves=ln_2)  # -> Points, IndexA, IndexB, ParamA, ParamB
item_5 = ListItem(List=mcx.Points, Index=Slider(0, range=0..100), Wrap=True)
item_6 = ListItem(List=mcx.Points, Index=Slider(2, range=0..10), Wrap=True)
item_7 = ListItem(List=mcx.Points, Index=number_slider_2, Wrap=True)
rec_3pt = Rectangle3Pt(PointA=item_7, PointB=item_5, PointC=item_6)  # -> Rectangle, Length
explode_3 = Explode(Curve=rec_3pt.Rectangle, Recursive=True)  # -> Segments, Vertices
flip_2 = FlipCurve(Curve=explode_3.Segments)  # -> Curve, Flag
curvepoint_5 = PointOnCurve(flip_2.Curve, parameter=0.5)
curvepoint_6 = PointOnCurve(flip_2.Curve, parameter=0)
shift_3 = ShiftList(List=curvepoint_6, Shift=1, Wrap=True)
ln_3 = Line(StartPoint=curvepoint_5, EndPoint=shift_3)
merge_2 = Merge(Data1=ln_3, Data2=flip_2.Curve)
merge_3 = Merge(Data1=bang.Branch0, Data2=bang.Branch1, Data3=bang.Branch2, Data4=bang.Branch3, Data5=bang.Branch4, Data6=merge_2)
ext = ExtendCurve(Curve=merge_3, Type=0, Start=number_slider_3, End=number_slider_3)  # -> flatten(Curve)
crv_3 = Curve(reparameterize(ext))

geo = Geometry(merge_3)
panel = Panel(crv_3)
trim = TrimWithRegions(Curve=crv_3, Regions=crv_2)  # -> Inside, Outside

crv_4 = Curve(trim.Inside)

panel_2 = Panel(crv_4)
viewer = ParamViewer(panel_2)
