# Grasshopper definition January10tth2020TedeschiChapter003Advanced.gh (Grasshopper 1.0.7)
# plug-ins: Bifocals

# ----
# Create
# Two crvs
# and
# Two Srf
#  in Rhino
soft_srf_edit_freeform_srf = Surface(<surface referenced from the Rhino model>)
planar_backing = Surface(<surface referenced from the Rhino model>)
x_line = Curve(<curve referenced from the Rhino model>)
y_line = Curve(<curve referenced from the Rhino model>)

number_slider = Slider(90, range=0..1000)
crv = Curve(x_line)
neg = Negative(Value=number_slider)
ext = ExtendCurve(Curve=crv, Type=0, Start=neg, End=neg)
divdist = DivideDistance(Curve=ext, Distance=number_slider)  # -> Points, Tangents, Parameters
yz = YZPlane(Origin=divdist.Points)

number_slider_2 = Slider(120, range=0..1000)
crv_2 = Curve(y_line)
neg_2 = Negative(Value=number_slider_2)
ext_2 = ExtendCurve(Curve=crv_2, Type=0, Start=neg_2, End=neg_2)
divdist_2 = DivideDistance(Curve=ext_2, Distance=number_slider_2)  # -> Points, Tangents, Parameters
xz = XZPlane(Origin=divdist_2.Points)

srf = Surface(planar_backing)
srf_2 = Surface(soft_srf_edit_freeform_srf)
sec = BrepPlane(Brep=srf_2, Plane=yz)  # -> Curves, Points
sec_2 = BrepPlane(Brep=srf, Plane=yz)  # -> Curves, Points
sec_3 = BrepPlane(Brep=srf_2, Plane=xz)  # -> Curves, Points
sec_4 = BrepPlane(Brep=srf, Plane=xz)  # -> Curves, Points
merge = Merge(Data1=sec_2.Curves, Data2=sec.Curves)
merge_2 = Merge(Data1=sec_4.Curves, Data2=sec_3.Curves)
loft = Loft(Curves=merge_2, Options={Adjust=False, Closed=False, LoftEnds=0, LoftSimp=0, LoftType=0, Rebuild=10, Refit=0.01})
loft_2 = Loft(Curves=merge, Options={Adjust=False, Closed=False, LoftEnds=0, LoftSimp=0, LoftType=0, Rebuild=10, Refit=0.01})

number_slider_3 = Slider(10, range=0..10)
neg_3 = Negative(Value=number_slider_3)
merge_3 = Merge(Data1=number_slider_3, Data2=neg_3)
Y = UnitY(Factor=merge_3)
X = UnitX(Factor=merge_3)
extr = Extrude(Base=loft, Direction=Y)
extr_2 = Extrude(Base=loft_2, Direction=X)
sunion = SolidUnion(Breps=extr)
sunion_2 = SolidUnion(Breps=extr_2)

number_slider_4 = Slider(50, range=0..100)
number_slider_5 = Slider(10, range=0..10)

bbx = BrepBrep(BrepA=flatten(loft), BrepB=loft_2)  # -> Curves, Points
shatter = Shatter(Curve=reparameterize(bbx.Curves), Parameters=Slider(0.5, range=0..1))
number_slider_6 = Slider(0, range=0..1)
item = ListItem(List=shatter, Index=Slider(1, range=0..1), Wrap=True)
item_2 = ListItem(List=shatter, Index=Slider(0, range=0..100), Wrap=True)
ext_3 = ExtendCurve(Curve=item_2, Type=0, Start=number_slider_4, End=number_slider_6)
ext_4 = ExtendCurve(Curve=item, Type=0, Start=number_slider_6, End=number_slider_4)
number_slider_7 = Slider(2, range=0..10)
len = Length(Curve=ext_3)
len_2 = Length(Curve=ext_4)
curvepoint = PointOnCurve(ext_4, parameter=0.5)
curvepoint_2 = PointOnCurve(ext_3, parameter=0.5)
division = Division(A=len, B=number_slider_7)
division_2 = Division(A=len_2, B=number_slider_7)
addition = Addition(A=number_slider_5, B=Slider(5, range=0..10))
box = CenterBox(Base=curvepoint_2, X=number_slider_5, Y=addition, Z=division)
box_2 = CenterBox(Base=curvepoint, X=addition, Y=number_slider_5, Z=division_2)

sdiff = SolidDifference(BrepsA=flatten(sunion), BrepsB=flatten(box))
sdiff_2 = SolidDifference(BrepsA=flatten(sunion_2), BrepsB=flatten(box_2))

volume = Volume(Geometry=sdiff)  # -> Volume, Centroid
volume_2 = Volume(Geometry=sdiff_2)  # -> Volume, Centroid
yz_2 = YZPlane(Origin=volume_2.Centroid)
xz_2 = XZPlane(Origin=volume.Centroid)
sec_5 = BrepPlane(Brep=sdiff_2, Plane=yz_2)  # -> flatten(Curves), Points
sec_6 = BrepPlane(Brep=sdiff, Plane=xz_2)  # -> flatten(Curves), Points

number_slider_8 = Slider(240, range=0..1000)
number_slider_9 = Slider(30, range=0..100)

lng = ListLength(List=yz_2)
lng_2 = ListLength(List=xz_2)
series = Series(Start=0, Step=number_slider_8, Count=lng)
series_2 = Series(Start=0, Step=number_slider_8, Count=lng_2)
pt = ConstructPoint(XCoordinate=0, YCoordinate=series_2, ZCoordinate=0)
pt_2 = ConstructPoint(XCoordinate=Slider(1483, range=0..10000), YCoordinate=series, ZCoordinate=0)
xy = XYPlane(Origin=pt)
orient = Orient(Geometry=sec_6.Curves, Source=xz_2, Target=xy)  # -> Geometry, Transform

xy_2 = XYPlane(Origin=pt_2)

orient_2 = Orient(Geometry=sec_5.Curves, Source=yz_2, Target=xy_2)  # -> Geometry, Transform

area = Area(Geometry=orient_2.Geometry)  # -> Area, Centroid
area_2 = Area(Geometry=orient.Geometry)  # -> Area, Centroid
series_3 = Series(Start=0, Step=1, Count=lng_2)
series_4 = Series(Start=0, Step=1, Count=lng)
concat = Concatenate(FragmentA="a", FragmentB=series_3)
concat_2 = Concatenate(FragmentA="b", FragmentB=series_4)
tag = TextTag3D(Location=area_2.Centroid, Text=concat, Size=number_slider_9, Justification=7)
tag_2 = TextTag3D(Location=xz_2, Text=concat, Size=number_slider_9, Justification=7)
tag_3 = TextTag3D(Location=area.Centroid, Text=concat_2, Size=number_slider_9, Justification=7)
tag_4 = TextTag3D(Location=yz_2, Text=concat_2, Size=number_slider_9, Justification=7)
