# Grasshopper definition January10tth2020TedeschiChapter6SkinsLunchBoxHexCatmull-Clark.gh (Grasshopper 1.0.7)
# plug-ins: Bifocals, LunchBox, Weaverbird

srf_1 = Surface(reparameterize(<surface referenced from the Rhino model>))
hex = HexagonCells(Surface=srf_1, UDivisions=Slider(10, range=0..100), VDivisions=Slider(12, range=0..100), TParameter=0.25)  # -> HexagonCells, Centers
pt_1 = Point(hex.Centers)
crv_1 = Curve(hex.HexagonCells)
explode = Explode(Curve=crv_1, Recursive=True)  # -> Segments, Vertices

panel = Panel(explode.Segments)
lng = ListLength(List=explode.Segments)
panel_2 = Panel(lng)
eval = Evaluate(F="x=6", x=lng)
cull = CullPattern(List=crv_1, CullPattern=flatten(eval))
crv_2 = Curve(cull)

pt_1_2 = Point(pt_1)
elevation = Slider(-2.71, range=-12..12.01)

number_slider = Slider(0.6, range=0..1)
cull_2 = CullPattern(List=pt_1_2, CullPattern=flatten(eval))
pt_2 = Point(cull_2)

pt = Point(<point referenced from the Rhino model>)
dom = ConstructDomain(DomainStart=Slider(0.28, range=0..1), DomainEnd=Slider(0.82, range=0..1))

pt_2_2 = Point(pt_2)
srf_cp = SurfaceClosestPoint(Point=pt_2_2, Surface=srf_1)  # -> Point, UVPoint, Distance
evalsrf = EvaluateSurface(Surface=srf_1, Point=srf_cp.UVPoint)  # -> Point, Normal, UDirection, VDirection, Frame
multiplication = Multiplication(A=evalsrf.Normal, B=elevation)

pt_3 = Point(pt_2_2)
dist = Distance(PointA=pt, PointB=pt_3)
bnd = Bounds(Numbers=dist)
panel_3 = Panel(dist)
remap = RemapNumbers(Value=dist, Source=bnd, Target=dom)  # -> Mapped, Clipped
panel_4 = Panel(remap.Mapped)

scale = Scale(Geometry=crv_2, Center=pt_2, Factor=remap.Mapped)  # -> Geometry, Transform
crv_3 = Curve(scale.Geometry)
merge = Merge(Data1=graft(crv_2), Data2=graft(crv_3))
loft = Loft(Curves=merge, Options={Adjust=False, Closed=False, LoftEnds=0, LoftSimp=0, LoftType=0, Rebuild=10, Refit=0.01})

crv_3_2 = Curve(crv_3)
scale_2 = Scale(Geometry=crv_3_2, Center=pt_2_2, Factor=0.5)  # -> Geometry, Transform
crv_4 = Curve(scale_2.Geometry)
move = Move(Geometry=crv_4, Motion=multiplication)  # -> Geometry, Transform
crv_5 = Curve(move.Geometry)
crv_3_3 = Curve(crv_3_2)
merge_2 = Merge(Data1=graft(crv_3_3), Data2=graft(crv_5))
loft_2 = Loft(Curves=merge_2, Options={Adjust=False, Closed=False, LoftEnds=0, LoftSimp=0, LoftType=0, Rebuild=10, Refit=0.01})
crv_5_2 = Curve(crv_5)
explode_2 = Explode(Curve=crv_5_2, Recursive=True)  # -> Segments, Vertices
curvepoint = PointOnCurve(explode_2.Segments, parameter=0.566)
item = ListItem(List=explode_2.Segments, Index=0, Wrap=True)  # -> Item, Item1, Item2, Item3, Item4, Item5, Item6
flip = FlipCurve(Curve=item.Item4)  # -> Curve, Flag
flip_2 = FlipCurve(Curve=item.Item5)  # -> Curve, Flag
points = PointList(Points=curvepoint)
merge_3 = Merge(Data1=graft(item.Item2), Data2=graft(flip.Curve))
merge_4 = Merge(Data1=graft(item.Item1), Data2=graft(flip_2.Curve))
loft_3 = Loft(Curves=merge_4, Options={Adjust=False, Closed=False, LoftEnds=0, LoftSimp=0, LoftType=0, Rebuild=10, Refit=0.01})
loft_4 = Loft(Curves=merge_3, Options={Adjust=False, Closed=False, LoftEnds=0, LoftSimp=0, LoftType=0, Rebuild=10, Refit=0.01})

merge_5 = Merge(Data1=loft_4, Data2=loft_3, Data3=loft_2, Data4=loft)
geo = Geometry(merge_5)
srf = Surface(loft_4)
srf_2 = Surface(loft_3)
brep = Brep(loft)
brep_2 = Brep(loft_2)
join = BrepJoin(Breps=[srf, srf_2])  # -> Breps, Closed
mesh = MeshBrep(
    Brep=brep,
    Settings={GridMaxCount=0, GridMinCount=16, JaggedSeams=False, MaxEdgeLength=0, MinEdgeLength=0.0001, MinTolerance=0, Refine=True, RefineAngle=0, RelativeTolerance=0.65, SimplePlanes=True, Tolerance=0})
mesh_2 = MeshBrep(
    Brep=brep_2,
    Settings={GridMaxCount=0, GridMinCount=16, JaggedSeams=False, MaxEdgeLength=0, MinEdgeLength=0.0001, MinTolerance=0, Refine=True, RefineAngle=0, RelativeTolerance=0.65, SimplePlanes=True, Tolerance=0})
mesh_3 = MeshBrep(
    Brep=join.Breps,
    Settings={GridMaxCount=0, GridMinCount=16, JaggedSeams=False, MaxEdgeLength=0, MinEdgeLength=0.0001, MinTolerance=0, Refine=True, RefineAngle=0, RelativeTolerance=0.65, SimplePlanes=True, Tolerance=0})
merge_6 = Merge(Data1=mesh, Data2=mesh_2, Data3=mesh_3)
wbcatmullclark = WeaverbirdsCatmullClarkSubdivision(MeshCurves=merge_6, Level=Slider(2, range=0..10), SmoothNakedEdges=1)
