# Grasshopper definition January10tth2020TedeschiChapter7LoopsFractals.gh (Grasshopper 1.0.7)
# plug-ins: HoopSnake, Bifocals

crv = Curve(reparameterize(<curve referenced from the Rhino model>))
crv_2 = Curve(reparameterize(<curve referenced from the Rhino model>))
divide = DivideCurve(Curve=crv_2, Count=Slider(3, range=0..10), Kinks=False)  # -> Points, Tangents, Parameters
shatter = Shatter(Curve=crv_2, Parameters=divide.Parameters)
item = ListItem(List=shatter, Index=Slider(1, range=0..10), Wrap=True)
lng = ListLength(List=item)
expression = Expression(x=lng, y=Slider(6, range=0..10), Expression="y*(x/2)*Sqrt(3)")
neg = Negative(Value=expression)
offset = OffsetCurve(Curve=item, Distance=neg, Plane=PlaneXY(0, 0, 0), Corners=1)

panel = Panel("(x/2)*Sqrt(3)")

end = EndPoints(Curve=item)  # -> Start, End
curvepoint = PointOnCurve(offset, parameter=0.5)
cull_i = CullIndex(List=shatter, Indices=Slider(1, range=0..1), Wrap=True)
ln = Line(StartPoint=end.Start, EndPoint=curvepoint)
ln_2 = Line(StartPoint=curvepoint, EndPoint=end.End)
merge = Merge(Data1=cull_i, Data2=ln, Data3=ln_2)  # -> graft(Result)

crv_3 = Curve(<curve referenced from the Rhino model>)
number_slider = Slider(1, range=0..10)
divide_2 = DivideCurve(Curve=hs.Feedback, Count=Slider(3, range=0..10), Kinks=False)  # -> Points, Tangents, Parameters
hs = HoopSnake(
    StartingData=crv_3,
    Data=merge_2,
    TerminationCondition=Slider(4, range=0..10),
    Hoopsnake_Data_autoUpdate=False,
    Hoopsnake_Data_dataLimit=2147483647,
    Hoopsnake_Data_resetCounter=True,
    Hoopsnake_Data_updateView=True)  # -> Feedback, FeedbackHistory, LoopsCounter, IterationsCounter
shatter_2 = Shatter(Curve=hs.Feedback, Parameters=divide_2.Parameters)
item_2 = ListItem(List=shatter_2, Index=number_slider, Wrap=True)

len = Length(Curve=item_2)
panel_2 = Panel(hs.IterationsCounter)
eval = Evaluate(F="Sqrt(3)*(x/2)", x=len)

neg_2 = Negative(Value=eval)
offset_2 = OffsetCurve(Curve=item_2, Distance=neg_2, Plane=PlaneXY(0, 0, 0), Corners=1)

end_2 = EndPoints(Curve=item_2)  # -> Start, End
curvepoint_2 = PointOnCurve(offset_2, parameter=0.5)
cull_i_2 = CullIndex(List=shatter_2, Indices=number_slider, Wrap=True)
ln_3 = Line(StartPoint=end_2.Start, EndPoint=curvepoint_2)
ln_4 = Line(StartPoint=curvepoint_2, EndPoint=end_2.End)
merge_2 = Merge(Data1=cull_i_2, Data2=ln_3, Data3=ln_4)  # -> graft(Result)
