# Grasshopper definition January10tth2020TedeschiChapter7LoopsHoopSnakeComponent.gh (Grasshopper 1.0.7)
# plug-ins: HoopSnake, Bifocals

crv = Curve(<curve referenced from the Rhino model>)

# ----
# Loops
number_slider = Slider(3, range=0..10)
Y = UnitY(Factor=Slider(39, range=0..100))

hs = HoopSnake(
    StartingData=crv,
    Data=move.Geometry,
    TerminationCondition=Slider(5, range=0..10),
    Hoopsnake_Data_autoUpdate=False,
    Hoopsnake_Data_dataLimit=2147483647,
    Hoopsnake_Data_resetCounter=True,
    Hoopsnake_Data_updateView=True)  # -> Feedback, FeedbackHistory, LoopsCounter, IterationsCounter
panel = Panel(hs.IterationsCounter)

crv_2 = Curve(hs.FeedbackHistory)
divide = DivideCurve(Curve=hs.Feedback, Count=number_slider, Kinks=False)  # -> Points, Tangents, Parameters
shatter = Shatter(Curve=hs.Feedback, Parameters=divide.Parameters)
item = ListItem(List=shatter, Index=Slider(2, range=0..2), Wrap=True)
move = Move(Geometry=item, Motion=Y)  # -> Geometry, Transform
