# Grasshopper definition January12tth2020TedeschiChapterChapter8DigitalFabricationVase.gh (Grasshopper 1.0.7)
# plug-ins: Bifocals, Weaverbird

number_slider = Slider(11, range=1..24)
crv_1 = Curve(reparameterize(<curve referenced from the Rhino model>))
series = Series(Start=Slider(41, range=0..100), Step=Slider(22, range=0..30), Count=number_slider)
dom = ConstructDomain(DomainStart=Slider(1.473, range=0..10), DomainEnd=Slider(5.134, range=0..10))
subtraction = Subtraction(A=number_slider, B=Slider(1, range=0..1))
Z = UnitZ(Factor=series)
range = Range(Domain=dom, Steps=subtraction)
move = Move(Geometry=crv_1, Motion=Z)  # -> Geometry, Transform
graph = GraphMapper(
    range,
    x0=0,
    x1=10,
    y0=0,
    y1=2,
    container_name="Bezier",
    cpx=[0, 0.316077888, 0.7803914547, 1],
    cpy=[0.4509807825, 0.8192671537, 0.8465476632, 1])
area = Area(Geometry=move.Geometry)  # -> Area, Centroid
scale = Scale(Geometry=move.Geometry, Center=area.Centroid, Factor=graph)  # -> Geometry, Transform

Z_2 = UnitZ(Factor=1)
area_2 = Area(Geometry=crv_1)  # -> Area, Centroid
series_2 = Series(Start=0, Step=Slider(0.02, range=0..1), Count=number_slider)
line = LineSDL(Start=area_2.Centroid, Direction=Z_2, Length=1)
rotax = RotateAxis(Geometry=scale.Geometry, Angle=series_2, Axis=line)  # -> Geometry, Transform

line1 = Line(line)

loft = Loft(Curves=rotax.Geometry, Options={Adjust=False, Closed=False, LoftEnds=0, LoftSimp=0, LoftType=0, Rebuild=10, Refit=0.01})
item = ListItem(List=rotax.Geometry, Index=Slider(0, range=0..100), Wrap=True)
srf1 = Surface(loft)
crv2 = Curve(item)
eval = EvaluateCurve(Curve=crv2, Parameter=Slider(1, range=0..1))  # -> Point, Tangent, Angle
srf_cp = SurfaceClosestPoint(Point=eval.Point, Surface=srf1)  # -> Point, UVPoint, Distance
iso = IsoCurve(Surface=loft, UVPoint=srf_cp.UVPoint)  # -> UIsocurve, VIsocurve
pt = Point(area_2.Centroid)
crv3 = Curve(iso.UIsocurve)
end = EndPoints(Curve=crv3)  # -> Start, End
ln = Line(StartPoint=pt, EndPoint=end.Start)
merge = Merge(Data1=crv3, Data2=ln)

join = JoinCurves(Curves=merge, Preserve=False)
divide = DivideCurve(Curve=join, Count=Slider(19, range=0..100), Kinks=False)  # -> Points, Tangents, Parameters
nurbs = NurbsCurve(Vertices=divide.Points, Degree=3, Periodic=False)  # -> Curve, Length, Domain
railrev = RailRevolution(Curve=nurbs.Curve, Rail=crv2, Axis=line1, Scale=False)

bbox = BoundingBox(Content=railrev, Plane=PlaneXY(0, 0, 0))  # -> Box, Box_2
debrep = DeconstructBrep(Brep=bbox.Box)  # -> Faces, Edges, Vertices
graft = GraftTree(Tree=debrep.Vertices, IncludeEmptyLists=True, IncludeNullItems=True)  # -> simplify(Tree)
bang = ExplodeTree(Data=graft)  # -> Branch0, Branch1, Branch2, Branch3, Branch4, Branch5, Branch6, Branch7
pt_2 = Point(bang.Branch7)
pt_3 = Point(bang.Branch4)
Z_3 = UnitZ(Factor=Slider(-18, range=-100..101))
move_2 = Move(Geometry=pt_3, Motion=Z_3)  # -> Geometry, Transform
move_3 = Move(Geometry=pt_2, Motion=Z_3)  # -> Geometry, Transform
tbox = TwistedBox(
    CornerA=bang.Branch0,
    CornerB=bang.Branch1,
    CornerC=bang.Branch2,
    CornerD=bang.Branch3,
    CornerE=move_2.Geometry,
    CornerF=bang.Branch5,
    CornerG=bang.Branch6,
    CornerH=move_3.Geometry)
morph = BoxMorph(Geometry=railrev, Reference=bbox.Box, Target=tbox)

number_slider_2 = Slider(8, range=0..100)
mesh_uv = MeshSurface(Surface=morph, UCount=number_slider_2, VCount=number_slider_2, Overhang=True, Equalize=False)

demesh = DeconstructMesh(Mesh=mesh_uv)  # -> Vertices, Faces, Colours, Normals
cullpt = CullDuplicates(Points=demesh.Vertices, Tolerance=0.1, CullMode=3)  # -> Points, Indices, Valence
del = DelaunayMesh(Points=flatten(cullpt.Points), Plane=PlaneXY(0, 0, 0))
viewer = ParamViewer(cullpt.Points)
viewer_2 = ParamViewer(demesh.Vertices)

wbcatmullclark = WeaverbirdsCatmullClarkSubdivision(MeshCurves=del, Level=Slider(1, range=0..2), SmoothNakedEdges=1)
wbthicken = WeaverbirdsMeshThicken(MeshCurves=wbcatmullclark, Distance=Slider(10, range=0..10), OffsetType=0)
