# Grasshopper definition January12tth2020TedeschiChapterChapter8DigitalFabricationWaffling.gh (Grasshopper 1.0.7)
# plug-ins: Bifocals

srf = Surface(reparameterize(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))
debrep = DeconstructBrep(Brep=srf)  # -> Faces, Edges, Vertices
item = ListItem(List=debrep.Edges, Index=Slider(1, range=0..1), Wrap=True)
end = EndPoints(Curve=item)  # -> Start, End
vec2pt = Vector2Pt(PointA=end.Start, PointB=end.End, Unitize=False)  # -> Vector, Length

divdist = DivideDistance(Curve=item, Distance=Slider(24.16, range=0..30))  # -> Points, Tangents, Parameters

pl = PlaneNormal(Origin=divdist.Points, ZAxis=vec2pt.Vector)
sec = BrepPlane(Brep=srf, Plane=pl)  # -> Curves, Points

item_2 = ListItem(List=pl, Index=Slider(0, range=0..100), Wrap=True)
offset = OffsetCurve(Curve=sec.Curves, Distance=Slider(-2.811, range=-10..10.001), Plane=item_2, Corners=1)
divide = DivideCurve(Curve=offset, Count=Slider(100, range=0..100), Kinks=False)  # -> Points, Tangents, Parameters
nurbs = NurbsCurve(Vertices=divide.Points, Degree=3, Periodic=False)  # -> Curve, Length, Domain

end_2 = EndPoints(Curve=nurbs.Curve)  # -> Start, End
end_3 = EndPoints(Curve=sec.Curves)  # -> Start, End
ln = Line(StartPoint=end_3.End, EndPoint=end_2.End)
ln_2 = Line(StartPoint=end_3.Start, EndPoint=end_2.Start)
merge = Merge(Data1=simplify(sec.Curves), Data2=simplify(ln_2), Data3=simplify(nurbs.Curve), Data4=simplify(ln))

join = JoinCurves(Curves=merge, Preserve=False)  # -> flatten(Curves)
lng = ListLength(List=join)
series = Series(Start=0, Step=Slider(41, range=0..100), Count=lng)
X = UnitX(Factor=series)
eval = EvaluateCurve(Curve=reparameterize(join), Parameter=Slider(0.3, range=0..1))  # -> Point, Tangent, Angle
pt = Point(<point referenced from the Rhino model>)
neg = Negative(Value=X)
move = Move(Geometry=pt, Motion=neg)  # -> Geometry, Transform
pl_2 = PlaneNormal(Origin=eval.Point, ZAxis=eval.Tangent)
yz = YZPlane(Origin=move.Geometry)
orient = Orient(Geometry=join, Source=pl_2, Target=yz)  # -> Geometry, Transform
