# Grasshopper definition January13th2020TedeschiChapter009Advanced.gh (Grasshopper 1.0.7)
# plug-ins: Kangaroo Components, Bifocals, Weaverbird, Kangaroo2 Components

number_slider = Slider(10, range=0..10)
crv2 = Curve(reparameterize(<curve referenced from the Rhino model>))
crv1 = Curve(reparameterize(<curve referenced from the Rhino model>))
merge = Merge(Data1=crv1, Data2=crv2)
divide = DivideCurve(Curve=crv1, Count=number_slider, Kinks=False)  # -> Points, Tangents, Parameters
divide_2 = DivideCurve(Curve=crv2, Count=number_slider, Kinks=False)  # -> Points, Tangents, Parameters
loft = Loft(Curves=merge, Options={Adjust=False, Closed=False, LoftEnds=0, LoftSimp=0, LoftType=0, Rebuild=10, Refit=0.01})
ln = Line(StartPoint=divide_2.Points, EndPoint=divide.Points)
curvepoint = PointOnCurve(ln, parameter=0.5)
srf_cp = SurfaceClosestPoint(Point=curvepoint, Surface=loft)  # -> Point, UVPoint, Distance
evalsrf = EvaluateSurface(Surface=loft, Point=srf_cp.UVPoint)  # -> Point, Normal, UDirection, VDirection, Frame
dom = ConstructDomain(DomainStart=Slider(-10, range=-10..10), DomainEnd=Slider(10, range=0..10))
lng = ListLength(List=evalsrf.Point)
range = Range(Domain=dom, Steps=expr("x-1", lng))
graph = GraphMapper(
    range,
    x0=-10,
    x1=10,
    y0=0,
    y1=1,
    Ox=0.5281221867,
    Oy=0.9545315504,
    Px=0.9753621221,
    Py=0.1541399956,
    container_name="Parabola")
multiplication = Multiplication(A=evalsrf.Normal, B=graph)
move = Move(Geometry=evalsrf.Point, Motion=multiplication)  # -> Geometry, Transform
end = EndPoints(Curve=ln)  # -> Start, End
panel = Panel(graph)
arc = Arc3Pt(PointA=end.Start, PointB=move.Geometry, PointC=end.End)  # -> Arc, Plane, Radius

loft_opt = LoftOptions(Closed=False, Adjust=False, Rebuild=Slider(50, range=0..100), Refit=0, Type=0)
loft_2 = Loft(Curves=arc.Arc, Options=loft_opt)
srfsplit = SurfaceSplit(Surface=loft_2, Curves=arc.Arc)
debrep = DeconstructBrep(Brep=srfsplit)  # -> Faces, Edges, Vertices
panel_2 = Panel(srfsplit)
item = ListItem(List=debrep.Edges, Index=0, Wrap=True)  # -> Item, Item1, Item2, Item3, Item4
edgesrf = EdgeSurface(CurveA=item.Item1, CurveB=item.Item2, CurveC=item.Item3, CurveD=item.Item4)
panel_3 = Panel(edgesrf)

number_slider_2 = Slider(6, range=0..10)
mesh_uv = MeshSurface(Surface=edgesrf, UCount=number_slider_2, VCount=number_slider_2, Overhang=True, Equalize=False)
wbjoin = WeaverbirdsJoinMeshesAndWeld(Mesh=flatten(mesh_uv), Weld=False)
timer = Timer(TimerInterval=5, Target=kangaroo)

# ----
# Remove Duplicate
# pts and lines
# hidden in
#  Kangaroo Utilities!!!
wbedges = WeaverbirdsMeshEdges(MeshOrPolylines=mesh_uv)
wbvertices = WeaverbirdsVerticesComponent(MeshClosedPolylinesGroup=mesh_uv, Weld=True)
dupln = RemoveDuplicateLines(Lines=flatten(wbedges), Tolerance=0.01)
duppt = RemoveDuplicatePts(Points=flatten(wbvertices), Tolerance=0.01)

# ----
# Particle Spring
# System
number_slider_3 = Slider(600, range=0..1000)
len = Length(Curve=dupln)
nv = NakedVertices(Mesh=mesh_uv)  # -> ClothedIndex, NakedIndex, ClothedPts, NakedPts
multiplication_2 = Multiplication(A=len, B=Slider(1, range=0..1))
Z = UnitZ(Factor=Slider(-10, range=-10..11))
springs = SpringsFromLine(
    Connection=dupln,
    Stiffness=number_slider_3,
    Damping=10,
    RestLength=multiplication_2,
    UpperCutoff=0,
    LowerCutoff=0,
    Plasticity=0)
uforce = UnaryForce(Point=duppt, Force=Z)
duppt_2 = RemoveDuplicatePts(Points=flatten(nv.NakedPts), Tolerance=0.01)

kangaroo = KangarooPhysics(
    ForceObjects=flatten([springs, uforce]),
    AnchorPoints=duppt_2,
    Settings=null,
    Geometry=wbjoin,
    SimulationReset=Toggle(True))  # -> Out, Iterations, ParticlesOut, GeometryOut, KE
wbcatmullclark = WeaverbirdsCatmullClarkSubdivision(MeshCurves=kangaroo.GeometryOut, Level=Slider(2, range=0..10), SmoothNakedEdges=1)
