# Grasshopper definition January13th2020TedeschiChapter009AdvancedMembraneSimulation.gh (Grasshopper 1.0.7)
# plug-ins: MeshEdit Components, Kangaroo Components, Weaverbird, Kangaroo2 Components

# ----
# Membrane Simulation
# 
# Discretization
number_slider = Slider(17, range=0..100)
srf = Surface(reparameterize(<surface referenced from the Rhino model>))
mesh_uv = MeshSurface(Surface=srf, UCount=number_slider, VCount=number_slider, Overhang=True, Equalize=False)
wbedges = WeaverbirdsMeshEdges(MeshOrPolylines=mesh_uv)
wbvertices = WeaverbirdsVerticesComponent(MeshClosedPolylinesGroup=mesh_uv, Weld=True)

# ----
# Can be multi anchored as well
number_slider_2 = Slider(91, range=0..100)
item = ListItem(List=wbvertices, Index=number_slider_2, Wrap=True)
item_2 = ListItem(List=wbvertices, Index=Slider(100, range=0..100), Wrap=True)
pt = Point(item)
pt_2 = Point(item_2)

# ----
# Spring-Particle System
number_slider_3 = Slider(1, range=0..1)
line = Line(wbedges)
pt_3 = Point(wbvertices)
len = Length(Curve=line)
multiplication = Multiplication(A=len, B=number_slider_3)
Z = UnitZ(Factor=Slider(-20, range=-21..22))
springs = SpringsFromLine(
    Connection=line,
    Stiffness=Slider(50, range=0..10000),
    Damping=10,
    RestLength=multiplication,
    UpperCutoff=0,
    LowerCutoff=0,
    Plasticity=0)
uforce = UnaryForce(Point=pt_3, Force=Z)
mc = MeshCorners(Mesh=mesh_uv, Angle=2.35619449)

mesh = Mesh(mesh_uv)

kangaroo = KangarooPhysics(
    ForceObjects=flatten([springs, uforce]),
    AnchorPoints=[mc, pt, pt_2],
    Settings=null,
    Geometry=mesh,
    SimulationReset=Toggle(False))  # -> Out, Iterations, ParticlesOut, GeometryOut, KE
timer = Timer(TimerInterval=1000, Target=kangaroo)

mesh_2 = Mesh(kangaroo.GeometryOut)

# ----
# More Like a Cable Net!
# Membrane Simulation
# 
# Diagonals added to
# prevent deforming
# 
# Discretization
# Make Diagonals to stop distortion
# 
# Test with different patterns of diagonals and grids
number_slider_4 = Slider(17, range=0..100)
srf_2 = Surface(reparameterize(<surface referenced from the Rhino model>))
mesh_uv_2 = MeshSurface(Surface=srf_2, UCount=number_slider_4, VCount=number_slider_4, Overhang=True, Equalize=False)
explode = MeshExplode(Mesh=mesh_uv_2, Interpolate=False)
wbedges_2 = WeaverbirdsMeshEdges(MeshOrPolylines=mesh_uv_2)
wbvertices_2 = WeaverbirdsVerticesComponent(MeshClosedPolylinesGroup=mesh_uv_2, Weld=True)
wbvertices_3 = WeaverbirdsVerticesComponent(MeshClosedPolylinesGroup=explode, Weld=True)
item_3 = ListItem(List=wbvertices_3, Index=Slider(0, range=0..100), Wrap=True)
item_4 = ListItem(List=wbvertices_3, Index=Slider(1, range=0..1), Wrap=True)
item_5 = ListItem(List=wbvertices_3, Index=Slider(2, range=0..10), Wrap=True)
item_6 = ListItem(List=wbvertices_3, Index=Slider(3, range=0..10), Wrap=True)
ln = Line(StartPoint=item_4, EndPoint=item_6)
ln_2 = Line(StartPoint=item_3, EndPoint=item_5)
merge = Merge(Data1=ln_2, Data2=ln)
timer_2 = Timer(TimerInterval=1000, Target=kangaroo_2)

# ----
# Spring-Particle System
number_slider_5 = Slider(719, range=0..10000)
line_2 = Line(wbedges_2)
line_3 = Line(merge)
pt_4 = Point(wbvertices_2)
len_2 = Length(Curve=line_2)
len_3 = Length(Curve=line_3)
multiplication_2 = Multiplication(A=len_2, B=Slider(1, range=0..1))
multiplication_3 = Multiplication(A=len_3, B=Slider(1, range=0..1))
Z_2 = UnitZ(Factor=Slider(-20, range=-21..22))
springs_2 = SpringsFromLine(Connection=line_3, Stiffness=1000, Damping=10, RestLength=multiplication_3, UpperCutoff=0, LowerCutoff=0, Plasticity=0)
springs_3 = SpringsFromLine(Connection=line_2, Stiffness=1000, Damping=10, RestLength=multiplication_2, UpperCutoff=0, LowerCutoff=0, Plasticity=0)
uforce_2 = UnaryForce(Point=pt_4, Force=Z_2)
mc_2 = MeshCorners(Mesh=mesh_uv_2, Angle=2.35619449)

kangaroo_2 = KangarooPhysics(
    ForceObjects=flatten([springs_3, uforce_2, springs_2]),
    AnchorPoints=mc_2,
    Settings=null,
    Geometry=mesh_uv_2,
    SimulationReset=Toggle(False))  # -> Out, Iterations, ParticlesOut, GeometryOut, KE
mesh_3 = Mesh(kangaroo_2.GeometryOut)
