# Grasshopper definition January13th2020TedeschiChapter009AdvancedParticleSprings.gh (Grasshopper 1.0.7)
# plug-ins: Kangaroo Components

# ----
# Playing Around
number_slider = Slider(100, range=0..100)
pt = ConstructPoint(XCoordinate=number_slider, YCoordinate=0, ZCoordinate=0)
pt_2 = ConstructPoint(XCoordinate=0, YCoordinate=0, ZCoordinate=0)
Z = UnitZ(Factor=Slider(20, range=-20..20))
move = Move(Geometry=pt, Motion=Z)  # -> Geometry, Transform
ln = Line(StartPoint=pt_2, EndPoint=move.Geometry)

# ----
# Cable Simulation
# Engine
# Discretization
number_slider_2 = Slider(10, range=0..10)
# Front Viewport
# 
# Particle Spring Systems:
# Particles
# Springs
# Forces
# Anchor Points
# 
# Discretization: lines and pts
# Particle-spring system:Particles/Springs/Forces/Anchor Points
# Kangaroo Engine: Start/Stop
crv = Curve(reparameterize(ln))
divide = DivideCurve(Curve=crv, Count=number_slider_2, Kinks=False)  # -> Points, Tangents, Parameters
shatter = Shatter(Curve=crv, Parameters=divide.Parameters)

# ----
# Cable Simulation
# Engine
# Discretization
number_slider_3 = Slider(10, range=0..10)
crv_2 = Curve(reparameterize(<curve referenced from the Rhino model>))
divide_2 = DivideCurve(Curve=crv_2, Count=number_slider_3, Kinks=False)  # -> Points, Tangents, Parameters
shatter_2 = Shatter(Curve=crv_2, Parameters=divide_2.Parameters)

# ----
# Hooke's Law
# Engine
# Discretization
number_slider_4 = Slider(9, range=0..10)
crv_3 = Curve(reparameterize(<curve referenced from the Rhino model>))
divide_3 = DivideCurve(Curve=crv_3, Count=number_slider_4, Kinks=False)  # -> Points, Tangents, Parameters
shatter_3 = Shatter(Curve=crv_3, Parameters=divide_3.Parameters)

# ----
# Particle Spring System
number_slider_5 = Slider(50, range=50..51)
pt_3 = Point(divide.Points)
line = Line(shatter)
Z_2 = UnitZ(Factor=number_slider_5)
end = EndPoints(Curve=crv)  # -> Start, End
springs = SpringsFromLine(Connection=line, Stiffness=1000, Damping=10, RestLength=line, UpperCutoff=0, LowerCutoff=0, Plasticity=0)
uforce = UnaryForce(Point=pt_3, Force=Z_2)

# ----
# Particle Spring System
number_slider_6 = Slider(50, range=50..51)
pt_4 = Point(divide_2.Points)
line_2 = Line(shatter_2)
Z_3 = UnitZ(Factor=number_slider_6)
end_2 = EndPoints(Curve=crv_2)  # -> Start, End
springs_2 = SpringsFromLine(Connection=line_2, Stiffness=1000, Damping=10, RestLength=line_2, UpperCutoff=0, LowerCutoff=0, Plasticity=0)
uforce_2 = UnaryForce(Point=pt_4, Force=Z_3)

# ----
# Particle Spring System
number_slider_7 = Slider(50, range=50..51)
pt_5 = Point(divide_3.Points)
line_3 = Line(shatter_3)
Z_4 = UnitZ(Factor=number_slider_7)
end_3 = EndPoints(Curve=crv_3)  # -> Start, End
springs_3 = SpringsFromLine(Connection=line_3, Stiffness=1000, Damping=10, RestLength=line_3, UpperCutoff=0, LowerCutoff=0, Plasticity=0)
uforce_3 = UnaryForce(Point=pt_5, Force=Z_4)

# ----
# Anchor Points are added
number_slider_8 = Slider(6, range=0..10)
item = ListItem(List=pt_4, Index=number_slider_8, Wrap=True)  # disabled

# ----
# Continuity
kangaroo = KangarooPhysics(
    ForceObjects=flatten([springs, uforce]),
    AnchorPoints=[end.End, end.Start],
    Settings=null,
    Geometry=line,
    SimulationReset=Toggle(True))  # -> Out, Iterations, ParticlesOut, GeometryOut, KE
timer = Timer(TimerInterval=5, Target=kangaroo)  # disabled

kangaroo_2 = KangarooPhysics(
    ForceObjects=flatten([springs_2, uforce_2]),
    AnchorPoints=[end_2.End, end_2.Start, item],
    Settings=null,
    Geometry=line_2,
    SimulationReset=Toggle(True))  # -> Out, Iterations, ParticlesOut, GeometryOut, KE
timer_2 = Timer(TimerInterval=5, Target=kangaroo_2)  # disabled

kangaroo_3 = KangarooPhysics(
    ForceObjects=flatten([springs_3, uforce_3]),
    AnchorPoints=[end_3.End, end_3.Start, item],
    Settings=null,
    Geometry=line_3,
    SimulationReset=Toggle(False))  # -> Out, Iterations, ParticlesOut, GeometryOut, KE
timer_3 = Timer(TimerInterval=5, Target=kangaroo_3)  # disabled

join = JoinCurves(Curves=kangaroo_3.GeometryOut, Preserve=False)
panel = Panel(kangaroo_3.GeometryOut)

# ----
# Works only with
# two anchor points
# to test continuity
intcrv = Interpolate(Vertices=kangaroo_2.ParticlesOut, Degree=3, Periodic=False, KnotStyle=1)  # -> Curve, Length, Domain

len = Length(Curve=join)
panel_2 = Panel(len)

# ----
# Particle Spring System
line_4 = Line(Line((-4, 0, 17), (-4, 0, -8)))
end_4 = EndPoints(Curve=line_4)  # -> Start, End
Z_5 = UnitZ(Factor=Slider(-49, range=-150..151))
uforce_4 = UnaryForce(Point=end_4.End, Force=Z_5)

# ----
# Hooke's Law
# rest Length
# 
# Connections
# Stiffnbess
# Damping
# Rest Length
# Upper/Lower Cutoffs
# Plasticity
# Engine
number_slider_9 = Slider(2, range=0..10)
len_2 = Length(Curve=line_4)
panel_3 = Panel(len_2)

springs_4 = SpringsFromLine(Connection=line_4, Stiffness=number_slider_9, Damping=10, RestLength=line_4, UpperCutoff=0, LowerCutoff=0, Plasticity=0)

kangaroo_4 = KangarooPhysics(
    ForceObjects=flatten([springs_4, uforce_4]),
    AnchorPoints=[end_4.Start, item],
    Settings=null,
    Geometry=line_4,
    SimulationReset=Toggle(False))  # -> Out, Iterations, ParticlesOut, GeometryOut, KE
timer_4 = Timer(TimerInterval=5, Target=kangaroo_4)  # disabled

len_3 = Length(Curve=kangaroo_4.GeometryOut)
panel_4 = Panel(len_3)
