# Grasshopper definition January13th2020TedeschiChapter009AdvancedShellSimulationBehavior.gh (Grasshopper 1.0.7)
# plug-ins: MeshEdit Components, Kangaroo Components, Weaverbird, Kangaroo2 Components

number_slider = Slider(44, range=0..100)
mesh = Mesh(<mesh referenced from the Rhino model>)

msphere = MeshSphere(Base=PlaneXY(0, 0, 0), Radius=10, UCount=number_slider, VCount=number_slider)
# Discretization
explode = MeshExplode(Mesh=mesh, Interpolate=False)
wbedges = WeaverbirdsMeshEdges(MeshOrPolylines=mesh)
wbvertices = WeaverbirdsVerticesComponent(MeshClosedPolylinesGroup=mesh, Weld=True)
demesh = DeconstructMesh(Mesh=explode)  # -> Vertices, Faces, Colours, Normals
item = ListItem(List=demesh.Vertices, Index=Slider(0, range=0..1), Wrap=True)
item_2 = ListItem(List=demesh.Vertices, Index=Slider(1, range=0..1), Wrap=True)
item_3 = ListItem(List=demesh.Vertices, Index=Slider(2, range=0..2), Wrap=True)
item_4 = ListItem(List=demesh.Vertices, Index=Slider(3, range=0..3), Wrap=True)
ln = Line(StartPoint=item, EndPoint=item_3)
ln_2 = Line(StartPoint=item_2, EndPoint=item_4)
merge = Merge(Data1=ln, Data2=ln_2)

# ----
# Shell component is gone from Kangaroo 1 Utility
# 
# Hinge component is similar in icon but does not accept the Mesh, only 4 pioints.
# 
# What to do?
# 
# HINGE POINTS!!!
mesh_2 = Mesh(mesh)

dupln = RemoveDuplicateLines(Lines=flatten(merge), Tolerance=0.01)
line = Line(flatten(dupln))
Z = UnitZ(Factor=Slider(-6, range=-20..100))
springs = SpringsFromLine(
    Connection=line,
    Stiffness=Slider(938, range=0..10000),
    Damping=10,
    RestLength=line,
    UpperCutoff=0,
    LowerCutoff=0,
    Plasticity=0)
uforce = UnaryForce(Point=wbvertices, Force=Z)

hingepoints = HingePoints(Mesh=mesh_2)  # -> _1, _2, _3, _4
hinge = Hinge(
    Point1=hingepoints._1,
    Point2=hingepoints._2,
    Point3=hingepoints._3,
    Point4=hingepoints._4,
    Strength=Slider(21, range=0..1000),
    RestAngle=Slider(1, range=0..1))
kangaroo_settings = KangarooSettings(
    Tolerance=0.01,
    TimeStep=Slider(0.005, range=0..0.01),
    SubIterations=10,
    Floor=Toggle(True),
    Drag=1,
    Restitution=0.7,
    StaticFriction=10,
    KineticFriction=10,
    Settle=2,
    Tumble=1,
    Sound=False,
    Solver=0)
kangaroo = KangarooPhysics(ForceObjects=flatten([springs, uforce, hinge]), Settings=kangaroo_settings, Geometry=mesh, SimulationReset=Toggle(True))  # -> Out, Iterations, ParticlesOut, GeometryOut, KE
timer = Timer(TimerInterval=5, Target=kangaroo)  # disabled
mesh_3 = Mesh(kangaroo.GeometryOut)
panel = Panel(mesh_3)
