# Grasshopper definition January14th2020TedeschiChapter10Karamba.gh (Grasshopper 1.0.7)
# plug-ins: karambaGH, goat

# ----
# Karamba
# 
# Shape Optimization
number_slider = Slider(2, range=0..10)
pt = Point(<point referenced from the Rhino model>)
Z = UnitZ(Factor=Slider(1, range=0..1))
pt_2 = Point(<point referenced from the Rhino model>)
readmattable = ReadMaterialTableFromFileKaramba3D()
readcstable = ReadCrossSectionTableFromFileKaramba3D()  # -> CrossSection, Info
ln = Line(StartPoint=pt_2, EndPoint=pt)
rev = Reverse(Vector=Z)
number_slider_2 = Slider(17, range=0..100)
supp = SupportKaramba3D(PosInd=pt_2, menu=[buttons(on, on, on, on, on, on)])
loads = LoadsKaramba3D(Vector=rev, LCase=pt, mode="Gravity")
matselect = MaterialSelectionKaramba3D(Materials=readmattable, NameOrListIndexOfMaterial=number_slider, menu=[dropdown(0), dropdown(0)])
linetobeam = LineToBeamKaramba3D(Line=ln, Color=ln, New=True, Remove=True, LimitDistance_m=0.005)  # -> Element, Points, Info
crosecselect = CrossSectionSelectorKaramba3D(CrossSections=readcstable.CrossSection, NameOrListIndexOfCrossSection=number_slider_2)  # -> CrossSection, Info
panel = Panel(crosecselect.CrossSection)
panel_2 = Panel(matselect)
assemble = AssembleModelKaramba3D(
    Elem=linetobeam.Element,
    Support=supp,
    Load=loads,
    CrossSection=crosecselect.CrossSection,
    Material=matselect,
    LimitDistance_m=0.005)  # -> Model, Info, Mass_kg, CenterOfGravity
panel_3 = Panel(assemble.Model)
analyze = AnalyzeKaramba3D(Model=assemble.Model)  # -> CalculatedModel, MaximumDisplacement_cm, ResultingForceOfGravity_kN, ElasticEnergy_kNm
modelview = ModelViewKaramba3D(Model=analyze.CalculatedModel, ResultFactors=1, ResultCase=-1)  # -> Model, DeformedMesh, DeformedAxes, DeformedModel
num = Number(analyze.MaximumDisplacement_cm)
panel_4 = Panel(num)
beamview = BeamViewKaramba3D(Model=modelview.Model)  # -> Model, MeshesOfRenderedBeams, DeformedBeamAxes, LegendColors, LegendTags

goat = Goat(fitness=num, gene=number_slider_2)
