# Grasshopper definition January14th2020TedeschiChapter10MillipedeTopologyOptimization002.gh (Grasshopper 1.0.7)
# plug-ins: Millipede

# ----
# Create a Rec in Rhino for boundary curves
# and
# two surfaces for boundary supports
toggle = BooleanToggle(True)
geo = Geometry(<brep referenced from the Rhino model>)
crv = Curve(<curve referenced from the Rhino model>)
geo_2 = Geometry(<brep referenced from the Rhino model>)
mat = SupportType(X=toggle, Y=Toggle(True), Z=Toggle(True), RX=Toggle(True), RY=Toggle(True), RZ=Toggle(True))
mat_2 = SupportType(X=Toggle(True), Y=Toggle(True), Z=Toggle(True), RX=Toggle(True), RY=Toggle(True), RZ=Toggle(True))
mat_3 = Material(MaterialType=5)
boundary = _2DBoundaryRegion(Boundary=crv, IsVoid=False)
support = _2DSupportRegion(Boundary=geo, SupportType=mat_2, AmendExistingSupports=True, Displacement=Vector(0, 0, 0))
support_2 = _2DSupportRegion(Boundary=geo_2, SupportType=mat, AmendExistingSupports=True, Displacement=Vector(0, 0, 0))
topostruct_2d = Topostruct2DModel(ModelComponents=[boundary, support, mat_3, support_2], XResolution=12)  # -> FEModel, CellCentres, CellSize
topostruct_2d_solver = Topostruct2DSolver(
    FEModel=topostruct_2d.FEModel,
    SelfWeightCoefficient=Slider(1, range=0..1),
    OptimizationIterations=Slider(1, range=0..1),
    Smoothing=0.1,
    Penalization=3,
    TargetDensity=Slider(0.568, range=0..1),
    MinimumDensity=0.001,
    DeleteThreshold=0.5,
    PeriodicX=False,
    PeriodicY=False,
    LoadCase=0,
    AllCases=True,
    CompliantMechanism=False)  # -> FEModel, MaxDeflection
panel = Panel(topostruct_2d_solver.MaxDeflection)
multiplication = Multiplication(A=topostruct_2d_solver.MaxDeflection, B=Slider(0, range=0..1))
_2d_mesh_results = _2DMeshResults(FEModel=topostruct_2d_solver.FEModel, Deflection=multiplication, ColorMode=3)
