# Grasshopper definition January14th2020TedeschiChapter10MillipedeTopologyOptimization003Bridge.gh (Grasshopper 1.0.7)
# plug-ins: Millipede

# ----
# Create a Rec in Rhino for boundary curves
# and
# Two more geometry curves for
# Fixed Geometry and
# Load
# Fixed Support Geometry
# The Load Attached
number_slider = Slider(1, range=0..1)
geo = Geometry(<curve referenced from the Rhino model>)
geo_2 = Geometry(<curve referenced from the Rhino model>)
crv = Curve(<curve referenced from the Rhino model>)
Y = UnitY(Factor=number_slider)
rev = Reverse(Vector=Y)
mat = SupportType(X=Toggle(True), Y=Toggle(True), Z=Toggle(True), RX=Toggle(True), RY=Toggle(True), RZ=Toggle(True))
load = _2DLoadRegion(Boundary=geo_2, Load=rev)
boundary = _2DBoundaryRegion(Boundary=crv, IsVoid=False)
support = _2DSupportRegion(Boundary=geo, SupportType=mat, AmendExistingSupports=True, Displacement=Vector(0, 0, 0))
topostruct_2d = Topostruct2DModel(ModelComponents=[boundary, support, load], XResolution=Slider(100, range=0..100))  # -> FEModel, CellCentres, CellSize
topostruct_2d_solver = Topostruct2DSolver(
    FEModel=topostruct_2d.FEModel,
    SelfWeightCoefficient=Slider(1, range=0..1),
    OptimizationIterations=Slider(1, range=0..1),
    Smoothing=0.1,
    Penalization=3,
    TargetDensity=Slider(0.452, range=0..1),
    MinimumDensity=0.001,
    DeleteThreshold=0.5,
    PeriodicX=False,
    PeriodicY=False,
    LoadCase=0,
    AllCases=True,
    CompliantMechanism=False)  # -> FEModel, MaxDeflection
panel = Panel(topostruct_2d_solver.MaxDeflection)
multiplication = Multiplication(A=topostruct_2d_solver.MaxDeflection, B=Slider(0, range=0..1))
_2d_mesh_results = _2DMeshResults(FEModel=topostruct_2d_solver.FEModel, Deflection=multiplication, ColorMode=2)
