# Grasshopper definition January6th2020BuchmanChapter3.gh (Grasshopper 1.0.7)
# plug-ins: Bifocals

# ----
# Set Point in Rhino Window with Rhino Command
# 
# Set one/multiple point/points to point container node
# 
# Manipulate Rhino Point in Rhino Window
pt = Point([<point referenced from the Rhino model> x3])
series = Series(Start=0, Step=1, Count=10)
series_2 = Series(Start=0, Step=1, Count=10)  # -> graft(Series)
pt_2 = ConstructPoint(XCoordinate=series, YCoordinate=series_2, ZCoordinate=0)
dist = Distance(PointA=pt_2, PointB=pt)
xy = XYPlane(Origin=pt_2)
cir = Circle(Plane=xy, Radius=dist)

# ----
# Number Slider
number_slider = Slider(7, range=0..10)
dom = ConstructDomain(DomainStart=0, DomainEnd=1)
range = Range(Domain=dom, Steps=number_slider)
pt_3 = ConstructPoint(XCoordinate=range, YCoordinate=0, ZCoordinate=0)

# ----
# Graph Mapper
number_slider_2 = Slider(7, range=0..10)
dom_2 = ConstructDomain(DomainStart=0, DomainEnd=1)
range_2 = Range(Domain=dom_2, Steps=number_slider_2)
pt_4 = ConstructPoint(XCoordinate=0, YCoordinate=Slider(0.01, range=0..0.01), ZCoordinate=range_2)
graph = GraphMapper(
    pt_4,
    x0=0,
    x1=1,
    y0=0,
    y1=1,
    container_name="Bezier",
    cpx=[0, 0.6103993058, 0.5217378139, 1],
    cpy=[0, 0.1854228377, 0.7514927387, 1])
xy_2 = XYPlane(Origin=pt_4)
cir_2 = Circle(Plane=xy_2, Radius=graph)
loft = Loft(Curves=cir_2, Options={Adjust=False, Closed=False, LoftEnds=0, LoftSimp=0, LoftType=0, Rebuild=10, Refit=0.01})
