# Grasshopper definition January6th2020BuchmanChapter4.gh (Grasshopper 1.0.7)
# plug-ins: Pufferfish, Bifocals

# ----
# Divide Domain^2 Node and Evaluate Surface
# 
# Map cones onto frames
number_slider = Slider(2, range=0..10)
cone = Cone(Base=PlaneXY(0, 0, 0), Radius=number_slider, Length=number_slider)  # -> reparameterize(Cone), Tip
dedom2 = DeconstructDomain²(Domain=cone.Cone)  # -> UComponent, VComponent
range = Range(Domain=dedom2.VComponent, Steps=10)  # -> graft(Range)
range_2 = Range(Domain=dedom2.UComponent, Steps=10)
pt = ConstructPoint(XCoordinate=range_2, YCoordinate=range, ZCoordinate=0)
evalsrf = EvaluateSurface(Surface=reparameterize(cone.Cone), Point=pt)  # -> Point, Normal, UDirection, VDirection, Frame
cone_2 = Cone(Base=evalsrf.Frame, Radius=Slider(0.102, range=0..1), Length=Slider(0.337, range=0..1))  # -> Cone, Tip

# ----
# Set Curve to Curve Container Node
crv = Curve(reparameterize(<curve referenced from the Rhino model>))
divide = DivideCurve(Curve=crv, Count=10, Kinks=False)  # -> Points, Tangents, Parameters
pframe = PerpFrame(Curve=crv, Parameter=divide.Parameters)
cir = Circle(Plane=pframe, Radius=1)

# ----
# Evaluated Surface Component
# 
# Reparameterize surface
number_slider_2 = Slider(0.557, range=0..1)
cone_3 = Cone(Base=PlaneXY(0, 0, 0), Radius=0.5, Length=1)  # -> Cone, Tip
pt_2 = ConstructPoint(XCoordinate=Slider(0.362, range=0..1), YCoordinate=number_slider_2, ZCoordinate=0)
evalsrf_2 = EvaluateSurface(Surface=reparameterize(cone_3.Cone), Point=pt_2)  # -> Point, Normal, UDirection, VDirection, Frame
cir_2 = Circle(Plane=evalsrf_2.Frame, Radius=1)

# ----
# Set Curve to Curve Container Node
crv_2 = Curve(reparameterize(<curve referenced from the Rhino model>))
range_3 = Range(Domain=Domain(0, 1), Steps=10)
hframe = HorizontalFrame(Curve=crv_2, Parameter=range_3)
pframe_2 = PerpFrame(Curve=crv_2, Parameter=range_3)
cir_3 = Circle(Plane=pframe_2, Radius=1)
cir_4 = Circle(Plane=hframe, Radius=1)

# ----
# Domain^2 Component Extracts U and V coords
cone_4 = Cone(Base=PlaneXY(0, 0, 0), Radius=0.5, Length=1)  # -> Cone, Tip
domain² = Domain²(cone_4.Cone)
panel = Panel(domain²)

# ----
# Set Curve to Curve Container Node
# 
# Note* Same effects
crv_3 = Curve(reparameterize(<curve referenced from the Rhino model>))
divide_2 = DivideCurve(Curve=crv_3, Count=10, Kinks=False)  # -> Points, Tangents, Parameters
pframes = PerpFrames(Curve=crv_3, Count=10, Align=True)  # -> Frames, Parameters
pframe_3 = PerpFrame(Curve=crv_3, Parameter=divide_2.Parameters)
cir_5 = Circle(Plane=pframe_3, Radius=1)
cir_6 = Circle(Plane=pframes.Frames, Radius=1)

# ----
# Set one surface  Paraboloid in Rhino command
# (oriented to Front viewport)
# to this container node
srf = Surface(<surface referenced from the Rhino model>)
dedom2_2 = DeconstructDomain²(Domain=srf)  # -> UComponent, VComponent
offsrf = OffsetSurface(Surface=srf, Distance=1, BothSides=False, CreateSolid=True)
range_4 = Range(Domain=dedom2_2.VComponent, Steps=10)  # -> graft(Range)
range_5 = Range(Domain=dedom2_2.UComponent, Steps=10)
sin = Sine(Value=range_4)
pt_3 = ConstructPoint(XCoordinate=range_5, YCoordinate=range_4, ZCoordinate=0)
sqr = Square(Value=sin)
evalsrf_3 = EvaluateSurface(Surface=srf, Point=pt_3)  # -> Point, Normal, UDirection, VDirection, Frame
multiplication = Multiplication(A=evalsrf_3.Normal, B=sqr)
subtraction = Subtraction(A=evalsrf_3.Point, B=multiplication)
srfgrid = SurfaceFromPoints(Points=flatten(subtraction), UCount=11, Interpolate=False)
