# Grasshopper definition January6th2020BuchmanChapter5.gh (Grasshopper 1.0.7)
# plug-ins: Bifocals

# ----
# Mapping Geometry to Surfaces
# 
# Set one brep and reparameterize a selected surface
number_slider = Slider(4, range=0..100)
brep = Brep(<brep referenced from the Rhino model>)
bbox = BoundingBox(Content=brep, Plane=PlaneXY(0, 0, 0), UnionBox=False)  # -> Box, Box_2
cyl = Cylinder(Base=PlaneXY(0, 0, 0), Radius=number_slider, Length=number_slider)
dom = ConstructDomain(DomainStart=Slider(0, range=0..1), DomainEnd=Slider(0.745, range=0..1))
dom_2 = ConstructDomain(DomainStart=Slider(0.214, range=0..1), DomainEnd=Slider(0.9, range=0..1))
dom_3 = ConstructDomain(DomainStart=Slider(0.114, range=0..1), DomainEnd=Slider(0.446, range=0..1))
srfmorph = SurfaceMorph(Geometry=brep, Reference=bbox.Box, Surface=reparameterize(cyl), UDomain=dom_3, VDomain=dom_2, WDomain=dom)

# ----
# Mapping Curves to Surfaces
cyl_2 = Cylinder(Base=PlaneXY(0, 0, 0), Radius=0.5, Length=1)
dedom2 = DeconstructDomain²(Domain=cyl_2)  # -> UComponent, VComponent
rectangle = Rectangle(Plane=PlaneXY(0, 0, 0), XSize=dedom2.UComponent, YSize=dedom2.VComponent, Radius=0)  # -> Rectangle, Length
pop2d = Populate2D(Region=rectangle.Rectangle, Count=100, Seed=1)
boundary = BoundarySurfaces(Edges=rectangle.Rectangle)
voronoi = Voronoi(Points=pop2d, Boundary=rectangle.Rectangle, BruteForceOverride=False)
map_srf = MapToSurface(Curve=voronoi, Source=boundary, Target=cyl_2)

# ----
# Paneling with Surface Morph
# 
# Use Divide Domain^2 in Math Domain tab
number_slider_2 = Slider(12, range=0..100)
brep_2 = Brep(<brep referenced from the Rhino model>)
bbox_2 = BoundingBox(Content=brep_2, Plane=PlaneXY(0, 0, 0), UnionBox=False)  # -> Box, Box_2
cyl_3 = Cylinder(Base=PlaneXY(0, 0, 0), Radius=number_slider_2, Length=number_slider_2)
dom_4 = ConstructDomain(DomainStart=0, DomainEnd=1)

divide = DivideDomain²(Domain=cyl_3, UCount=Slider(10, range=0..10), VCount=Slider(5, range=0..10))

dedom2_2 = DeconstructDomain²(Domain=divide)  # -> UComponent, VComponent
srfmorph_2 = SurfaceMorph(
    Geometry=brep_2,
    Reference=bbox_2.Box,
    Surface=cyl_3,
    UDomain=dedom2_2.UComponent,
    VDomain=dedom2_2.VComponent,
    WDomain=dom_4)
