# Grasshopper definition January6th2020BuchmanChapter6.gh (Grasshopper 1.0.7)

# ----
# Conditional List Processing with Dispatch and Weave components
# 
# Point in Curve component outputs 0, 1 , or 2 as data for equality and dispatch components
# 
# Curve is left open after being interpolated
number_slider = Slider(100, range=0..100)
crv = Curve(reparameterize(<curve referenced from the Rhino model>))
divide = DivideCurve(Curve=crv, Count=number_slider, Kinks=False)  # -> Points, Tangents, Parameters
offset = OffsetCurve(Curve=crv, Distance=1, Plane=PlaneXY(0, 0, 0), Corners=2)
curvature = Curvature(Curve=crv, Parameter=divide.Parameters)  # -> P, K, C
unit = UnitVector(Vector=curvature.K)
addition = Addition(A=curvature.P, B=unit)
incurve = PointInCurve(Point=addition, Curve=crv)  # -> Relationship, Point
equals = Equality(FirstNumber=incurve.Relationship, SecondNumber=0)  # -> Equality, Inequality
dispatch = Dispatch(List=unit, DispatchPattern=equals.Equality)  # -> ListA, ListB
neg = Negative(Value=dispatch.ListB)
weave = Weave(Pattern=equals.Equality, Stream0=neg, Stream1=dispatch.ListA, NullGaps=False)
addition_2 = Addition(A=curvature.P, B=weave)
intcrv = Interpolate(Vertices=addition_2, Degree=3, Periodic=False, KnotStyle=1)  # -> Curve, Length, Domain

# ----
# Paneling with Weave and Dispatch components
brep = Brep(<brep referenced from the Rhino model>)
number_slider_2 = Slider(2, range=0..2)
dup = DuplicateData(Data=brep, Number=2, Order=True)
dispatch_2 = Dispatch(List=dup, DispatchPattern=[True, False])  # -> ListA, ListB
cyl = Cylinder(Base=PlaneXY(0, 0, 0), Radius=number_slider_2, Length=number_slider_2)
xy = XYPlane(Origin=Point(0, 0, 0))
divide_2 = DivideDomain²(Domain=cyl, UCount=10, VCount=10)
mirror = Mirror(Geometry=dispatch_2.ListB, Plane=xy)  # -> Geometry, Transform
weave_2 = Weave(Pattern=[0, 1], Stream0=dispatch_2.ListA, Stream1=mirror.Geometry, NullGaps=False)
dedom2 = DeconstructDomain²(Domain=divide_2)  # -> UComponent, VComponent
dom = ConstructDomain(DomainStart=0, DomainEnd=1)
bbox = BoundingBox(Content=weave_2, Plane=PlaneXY(0, 0, 0), UnionBox=True)  # -> Box, Box_2
srfmorph = SurfaceMorph(Geometry=weave_2, Reference=bbox.Box, Surface=cyl, UDomain=dedom2.UComponent, VDomain=dedom2.VComponent, WDomain=dom)

# ----
# List Comparisons with Cross Reference Components
# 
# Play with Cross Reference Node settings and Zoom +/- inputs
# Use Lower Strict setting to create one line between every pair of points
# We compare the distance between every pair of points and find the smallest distance
planesrf = PlaneSurface(Plane=PlaneXY(0, 0, 0), XSize=Domain(-10, 10), YSize=Domain(-10, 10))
cir = Circle(Plane=PlaneXY(0, 0, 0), Radius=1)
series = Series(Start=0, Step=1, Count=10)
divide_3 = DivideCurve(Curve=cir, Count=10, Kinks=False)  # -> Points, Tangents, Parameters
pop2d = Populate2D(Region=planesrf, Count=100, Seed=1)
crossref = CrossReference(ListA=series, ListB=series, CrossMode=1)  # -> ListA, ListB
crossref_2 = CrossReference(ListA=divide_3.Points, ListB=divide_3.Points, CrossMode=5)  # -> ListA, ListB
crossref_3 = CrossReference(ListA=pop2d, ListB=pop2d, CrossMode=5)  # -> ListA, ListB
pt = ConstructPoint(XCoordinate=crossref.ListA, YCoordinate=crossref.ListB, ZCoordinate=0)
ln = Line(StartPoint=crossref_2.ListA, EndPoint=crossref_2.ListB)
dist = Distance(PointA=crossref_3.ListA, PointB=crossref_3.ListB)
bnd = Bounds(Numbers=dist)
dedomain = DeconstructDomain(Domain=bnd)  # -> Start, End
division = Division(A=dedomain.Start, B=Slider(2, range=2..5))
sph = Sphere(Base=pop2d, Radius=division)

# ----
# Recursion with Shift Lists Component
number_slider_3 = Slider(3, range=0..10)
cir_2 = Circle(Plane=PlaneXY(0, 0, 0), Radius=1)
divide_4 = DivideCurve(Curve=cir_2, Count=10, Kinks=False)  # -> Points, Tangents, Parameters
shift = ShiftList(List=divide_4.Points, Shift=number_slider_3, Wrap=True)
ln_2 = Line(StartPoint=shift, EndPoint=divide_4.Points)

# ----
# Set W or False if not circular in nature
number_slider_4 = Slider(6, range=0..10)
arc = Arc3Pt(PointA=Point(-2, 0, 0), PointB=Point(0, 2, 0), PointC=Point(2, 0, 0))  # -> Arc, Plane, Radius
divide_5 = DivideCurve(Curve=arc.Arc, Count=10, Kinks=False)  # -> Points, Tangents, Parameters
neg_2 = Negative(Value=number_slider_4)
shift_2 = ShiftList(List=divide_5.Points, Shift=neg_2, Wrap=False)
shift_3 = ShiftList(List=divide_5.Points, Shift=number_slider_4, Wrap=False)
ln_3 = Line(StartPoint=shift_3, EndPoint=shift_2)
