# Grasshopper definition January6th2020BuchmanCustomBevels.gh (Grasshopper 1.0.7)
# plug-ins: Bifocals

# ----
# create any closed curve and graphmapper the beveled edge!
number_slider = Slider(1, range=0..1)
number_slider_2 = Slider(0, range=0..100)
crv = Curve(<curve referenced from the Rhino model>)
number_slider_3 = Slider(10, range=0..100)
dom = ConstructDomain(DomainStart=number_slider_2, DomainEnd=number_slider)
dom_2 = ConstructDomain(DomainStart=Slider(-1, range=-1..1), DomainEnd=number_slider_2)
range = Range(Domain=dom_2, Steps=number_slider_3)
multiplication = Multiplication(A=Slider(0.688, range=0..1), B=range)
abs = Absolute(Value=range)
graph = GraphMapper(abs, x0=0, x1=1, y0=0, y1=1, container_name="Bezier", cpx=[0, 0, 0.4753623605, 1], cpy=[0, 1, 1, 1])
offset = OffsetCurve(Curve=crv, Distance=multiplication, Plane=PlaneXY(0, 0, 0), Corners=1)  # -> flatten(Curve)
divide = DivideCurve(Curve=offset, Count=Slider(49, range=0..1000), Kinks=False)  # -> Points, Tangents, Parameters
multiplication_2 = Multiplication(A=graph, B=Slider(1.8, range=0..3))
Z = UnitZ(Factor=multiplication_2)
item = ListItem(List=divide.Points, Index=0, Wrap=True)  # -> Item, Item1
move = Move(Geometry=[divide.Points, item.Item], Motion=graft(Z))  # -> Geometry, Transform
srfgrid = SurfaceFromPoints(Points=flatten(move.Geometry), UCount=expr("x+1", number_slider_3), Interpolate=False)
cap = CapHoles(Brep=srfgrid)
