# Grasshopper definition January6th2020BuchmanFacetedCylinder.gh (Grasshopper 1.0.7)
# plug-ins: Bifocals

number_slider = Slider(7.7, range=0..10)
cyl = Cylinder(Base=PlaneXY(0, 0, 0), Radius=Slider(5.9, range=0..10), Length=number_slider)
multiplication = Multiplication(A=number_slider, B=Slider(2, range=0..10))
pt = ConstructPoint(XCoordinate=0, YCoordinate=0, ZCoordinate=multiplication)
popgeo = PopulateGeometry(Geometry=cyl, Count=Slider(562, range=0..1000), Seed=1)
vec2pt = Vector2Pt(PointA=popgeo, PointB=pt, Unitize=False)  # -> Vector, Length
project = Project(Geometry=popgeo, Plane=PlaneXY(0, 0, 0))  # -> Geometry, Transform
projecta = ProjectAlong(Geometry=popgeo, Plane=PlaneXY(0, 0, 0), Direction=vec2pt.Vector)  # -> Geometry, Transform
unit = UnitVector(Vector=project.Geometry)
lng = ListLength(List=unit)
del = DelaunayMesh(Points=projecta.Geometry, Plane=PlaneXY(0, 0, 0))
random = Random(Range=Domain(0, 1), Number=lng, Seed=2)
faceb = FaceBoundaries(Mesh=del)
multiplication_2 = Multiplication(A=random, B=unit)
demesh = DeconstructMesh(Mesh=del)  # -> Vertices, Faces, Colours, Normals
len = Length(Curve=faceb)
addition = Addition(A=multiplication_2, B=popgeo)
larger = LargerThan(FirstNumber=len, SecondNumber=Slider(5.72, range=0..10))  # -> LargerThan, OrEqualTo
dispatch = Dispatch(List=demesh.Faces, DispatchPattern=larger.LargerThan)  # -> ListA, ListB
conmesh = ConstructMesh(Vertices=addition, Faces=dispatch.ListB)
