# Grasshopper definition January6th2020BuchmanSeaShells.gh (Grasshopper 1.0.7)
# plug-ins: Bifocals

number_slider = Slider(4, range=0..10)
rad = Radians(Degrees="360")
dom = ConstructDomain(DomainStart=0.1, DomainEnd=number_slider)
multiplication = Multiplication(A=number_slider, B="10")
range = Range(Domain=dom, Steps=multiplication)
crv = Curve(<curve referenced from the Rhino model>)
multiplication_2 = Multiplication(A=rad, B=range)
pow = Power(A=".5", B=range)
# Construct an irregular closed crv in the Top viewport
scale = Scale(Geometry=crv, Center=Point(0, 0, 0), Factor=multiplication_2)  # -> Geometry, Transform
pt = PointCylindrical(BasePlane=PlaneXY(0, 0, 0), Angle=multiplication_2, Radius=pow, Elevation=pow)
intcrv = Interpolate(Vertices=pt, Degree=3, Periodic=False, KnotStyle=1)  # -> Curve, Length, Domain
crv_cp = CurveClosestPoint(Point=pt, Curve=intcrv.Curve)  # -> Point, Parameter, Distance
curvature = Curvature(Curve=intcrv.Curve, Parameter=crv_cp.Parameter)  # -> P, K, C
eval = EvaluateCurve(Curve=intcrv.Curve, Parameter=crv_cp.Parameter)  # -> Point, Tangent, Angle
xprod = CrossProduct(VectorA=curvature.K, VectorB=eval.Tangent, Unitize=False)  # -> Vector, Length
pl = ConstructPlane(Origin=curvature.P, XAxis=curvature.K, YAxis=xprod.Vector)
orient = Orient(Geometry=scale.Geometry, Source=PlaneXY(0, 0, 0), Target=pl)  # -> Geometry, Transform
loft = Loft(Curves=orient.Geometry, Options={Adjust=False, Closed=False, LoftEnds=0, LoftSimp=0, LoftType=0, Rebuild=10, Refit=0.01})
