# Grasshopper definition January6th2020BuchmanStripedTorus.gh (Grasshopper 1.0.7)
# plug-ins: Bifocals

cir = Circle(Plane=PlaneXY(0, 0, 0), Radius=1)
pframes = PerpFrames(Curve=cir, Count=10, Align=True)  # -> Frames, Parameters
cir_2 = Circle(Plane=pframes.Frames, Radius=1)
series = Series(Start=0, Step=Slider(-1, range=-1..2), Count=10)
divide = DivideCurve(Curve=cir_2, Count=10, Kinks=False)  # -> Points, Tangents, Parameters
shift = ShiftList(List=divide.Points, Shift=graft(series), Wrap=True)
loft = Loft(Curves=cir_2, Options={Adjust=False, Closed=True, LoftEnds=0, LoftSimp=0, LoftType=0, Rebuild=10, Refit=0.01})
flip = FlipMatrix(Data=shift)
intcrv = Interpolate(Vertices=flip, Degree=3, Periodic=True, KnotStyle=1)  # -> Curve, Length, Domain
srf_cp = SurfaceClosestPoint(Point=flip, Surface=loft)  # -> Point, UVPoint, Distance
number_slider = Slider(0.075, range=0..1)
crv_cp = CurveClosestPoint(Point=flip, Curve=intcrv.Curve)  # -> Point, Parameter, Distance
evalsrf = EvaluateSurface(Surface=loft, Point=srf_cp.UVPoint)  # -> Point, Normal, UDirection, VDirection, Frame
eval = EvaluateCurve(Curve=intcrv.Curve, Parameter=crv_cp.Parameter)  # -> Point, Tangent, Angle
multiplication = Multiplication(A=number_slider, B=Slider(0.166, range=0..10))
neg = Negative(Value=number_slider)
neg_2 = Negative(Value=multiplication)
xprod = CrossProduct(VectorA=evalsrf.Normal, VectorB=eval.Tangent, Unitize=False)  # -> Vector, Length
dom = ConstructDomain(DomainStart=number_slider, DomainEnd=neg)
dom_2 = ConstructDomain(DomainStart=multiplication, DomainEnd=neg_2)
pl = ConstructPlane(Origin=evalsrf.Point, XAxis=evalsrf.Normal, YAxis=xprod.Vector)
rectangle = Rectangle(Plane=pl, XSize=dom, YSize=dom_2, Radius=0)  # -> Rectangle, Length
loft_2 = Loft(
    Curves=rectangle.Rectangle,
    Options={Adjust=False, Closed=True, LoftEnds=0, LoftSimp=0, LoftType=0, Rebuild=10, Refit=0.01})
