# Grasshopper definition January6th2020TedeschiChapter2.gh (Grasshopper 1.0.7)
# plug-ins: Bifocals

# ----
# Cross Reference Node
number_slider = Slider(0, range=0..10)
number_slider_2 = Slider(2, range=0..10)
number_slider_3 = Slider(5, range=0..10)
msphere = MeshSphere(Base=PlaneXY(0, 0, 0), Radius=Slider(0.35, range=0..1), UCount=10, VCount=20)
series = Series(Start=number_slider, Step=number_slider_2, Count=number_slider_3)
X = UnitX(Factor=series)
move = Move(Geometry=msphere, Motion=X)  # -> Geometry, Transform
series_2 = Series(Start=number_slider, Step=number_slider_2, Count=number_slider_3)
Y = UnitY(Factor=series_2)
crossref = CrossReference(ListA=move.Geometry, ListB=Y, CrossMode=1)  # -> ListA, ListB
series_3 = Series(Start=number_slider, Step=number_slider_2, Count=number_slider_3)
Z = UnitZ(Factor=series_3)
move_2 = Move(Geometry=crossref.ListA, Motion=crossref.ListB)  # -> Geometry, Transform
crossref_2 = CrossReference(ListA=move_2.Geometry, ListB=Z, CrossMode=1)  # -> ListA, ListB
move_3 = Move(Geometry=crossref_2.ListA, Motion=crossref_2.ListB)  # -> Geometry, Transform

# ----
# Random
number_slider_4 = Slider(10, range=0..100)
dom = ConstructDomain(DomainStart=number_slider_4, DomainEnd=Slider(95, range=0..100))
random = Random(Range=dom, Number=Slider(12, range=0..100), Seed=2)
panel = Panel(random)

# ----
# Functions with Single Variable
number_slider_5 = Slider(0, range=0..100)
dom_2 = ConstructDomain(DomainStart=number_slider_5, DomainEnd=Slider(18, range=0..100))
range = Range(Domain=dom_2, Steps=Slider(12, range=0..100))
eval = Evaluate(F="1/6*x^2", x=range)
panel_2 = Panel(range)
pt = ConstructPoint(XCoordinate=range, YCoordinate=eval, ZCoordinate=0)
panel_3 = Panel(eval)
intcrv = Interpolate(Vertices=pt, Degree=3, Periodic=False, KnotStyle=1)  # -> Curve, Length, Domain
mirror = Mirror(Geometry=intcrv.Curve, Plane=PlaneYZ(0, 0, 0))  # -> Geometry, Transform
join = JoinCurves(Curves=[intcrv.Curve, mirror.Geometry], Preserve=False)

# ----
# Functions with Two Variables
number_slider_6 = Slider(3, range=0..10)
number_slider_7 = Slider(25, range=0..100)
dom_3 = ConstructDomain(DomainStart=Slider(-3, range=-3..10), DomainEnd=number_slider_6)
dom_4 = ConstructDomain(DomainStart=Slider(-2, range=-2..10), DomainEnd=Slider(2, range=0..10))
range_2 = Range(Domain=dom_3, Steps=number_slider_7)
range_3 = Range(Domain=dom_4, Steps=number_slider_7)
crossref_3 = CrossReference(ListA=range_3, ListB=range_2, CrossMode=1)  # -> ListA, ListB
eval_2 = Evaluate(F="-((x^2+y^2)/4)+4", x=crossref_3.ListA, y=crossref_3.ListB)
lng = ListLength(List=range_2)
pt_2 = ConstructPoint(XCoordinate=crossref_3.ListA, YCoordinate=crossref_3.ListB, ZCoordinate=eval_2)
srfgrid = SurfaceFromPoints(Points=pt_2, UCount=lng, Interpolate=False)

# ----
# Conditionals
number_slider_8 = Slider(2, range=0..10)
eval_3 = Evaluate(F="x>5", x=number_slider_8)
eval_4 = Evaluate(F="x>5", x=[Slider(7, range=0..10), Slider(2, range=0..10)])
eval_5 = Evaluate(F="x+y=6", x=Slider(2, range=0..10), y=Slider(7, range=0..10))
panel_4 = Panel(eval_3)
panel_5 = Panel(eval_4)
panel_6 = Panel(eval_5)

# ----
# Repeat Data
# Set two curves to the
# curve container nodes
crv = Curve(<curve referenced from the Rhino model>)
crv_2 = Curve(<curve referenced from the Rhino model>)
number_slider_9 = Slider(13, range=0..20)
divide = DivideCurve(Curve=crv, Count=number_slider_9, Kinks=False)  # -> Points, Tangents, Parameters
number_slider_10 = Slider(8, range=0..10)
divide_2 = DivideCurve(Curve=crv_2, Count=number_slider_9, Kinks=False)  # -> Points, Tangents, Parameters
merge = Merge(Data1=Slider(3, range=0..10), Data2=Slider(5.035, range=0..10))
ln = Line(StartPoint=divide.Points, EndPoint=divide_2.Points)
lng_2 = ListLength(List=ln)
repeat = RepeatData(Data=merge, Length=lng_2)
curvepoint = PointOnCurve(ln, parameter=0.5)
Z_2 = UnitZ(Factor=repeat)
move_4 = Move(Geometry=curvepoint, Motion=Z_2)  # -> Geometry, Transform
vdis = VectorDisplay(Anchor=curvepoint, Vector=Z_2)
arc = Arc3Pt(PointA=divide.Points, PointB=move_4.Geometry, PointC=divide_2.Points)  # -> Arc, Plane, Radius
loft = Loft(Curves=arc.Arc, Options={Adjust=False, Closed=False, LoftEnds=0, LoftSimp=0, LoftType=0, Rebuild=10, Refit=0.01})

# ----
# Create a series of different size radii circles in
#  Rhino Window with Circle command
crv_3 = Curve([<curve referenced from the Rhino model> x4])
darc = DeconstructArc(Arc=crv_3)  # -> BasePlane, Radius, Angle
eval_6 = Evaluate(F="x>8", x=darc.Radius)
cull = CullPattern(List=crv_3, CullPattern=eval_6)
Z_3 = UnitZ(Factor=Slider(12, range=0..100))
extr = Extrude(Base=cull, Direction=Z_3)

crv_4 = Curve([<curve referenced from the Rhino model> x4])
darc_2 = DeconstructArc(Arc=crv_4)  # -> BasePlane, Radius, Angle
eval_7 = Evaluate(F="x>8", x=darc_2.Radius)
dispatch = Dispatch(List=crv_4, DispatchPattern=eval_7)  # -> ListA, ListB
Z_4 = UnitZ(Factor=Slider(38, range=0..100))
Z_5 = UnitZ(Factor=Slider(13, range=0..100))
extr_2 = Extrude(Base=dispatch.ListA, Direction=Z_4)
extr_3 = Extrude(Base=dispatch.ListB, Direction=Z_5)

# ----
# Concatenate
number_slider_11 = Slider(12, range=0..100)
concat = Concatenate(FragmentA="x>", FragmentB=number_slider_11)
concat_2 = Concatenate(FragmentA="The Cat ", FragmentB="is on the Table")
panel_7 = Panel(concat)
panel_8 = Panel(concat_2)

# ----
# Other Operators: Contains
# 
# create a Line in Rhino Window with Line Command
# 
# Set one line to Line container node
line = Line(Line((36, -34, 0), (-84, 42, 0)))
panel_9 = Panel(line)
eval_8 = Evaluate(F="Contains(x,\"Line\")", x=panel_9)
panel_10 = Panel(eval_8)

# ----
# Other Operators: Contains
panel_11 = Panel("Contains(x,\"4\")")
panel_12 = Panel("""1
2
34
4
5
6
7
8
9""")
eval_9 = Evaluate(F=panel_11, x=panel_12)
panel_13 = Panel(eval_9)

# ----
# if/then Conditional
number_slider_12 = Slider(20, range=0..100)
eval_10 = Evaluate(F="if(x>5, \"Hippy\", y)", x=number_slider_12, y=Slider(90, range=0..100))
panel_14 = Panel(eval_10)
