# Grasshopper definition January6th2020TedeschiChapter2RemappingNumbersAttractors.gh (Grasshopper 1.0.7)
# plug-ins: Bifocals

# ----
# Understanding Remapping
number_slider = Slider(2, range=0..10)
series = Series(Start=number_slider, Step=Slider(2, range=0..10), Count=Slider(4, range=0..10))
bnd = Bounds(Numbers=series)
dom = ConstructDomain(DomainStart=Slider(12, range=0..100), DomainEnd=Slider(96, range=0..100))
panel = Panel(series)
panel_2 = Panel(dom)
remap = RemapNumbers(Value=series, Source=bnd, Target=dom)  # -> Mapped, Clipped
panel_3 = Panel(bnd)
panel_4 = Panel(remap.Mapped)

# ----
# Attractors
number_slider_2 = Slider(1, range=0..10)
number_slider_3 = Slider(13, range=0..100)
multiplication = Multiplication(A=number_slider_2, B="2")
series_2 = Series(Start=0, Step=multiplication, Count=number_slider_3)
cir = Circle(Plane=PlaneXY(0, 0, 0), Radius=number_slider_2)
X = UnitX(Factor=series_2)
series_3 = Series(Start=0, Step=multiplication, Count=number_slider_3)
move = Move(Geometry=cir, Motion=X)  # -> Geometry, Transform
Y = UnitY(Factor=series_3)
crossref = CrossReference(ListA=move.Geometry, ListB=Y, CrossMode=1)  # -> ListA, ListB
move_2 = Move(Geometry=crossref.ListA, Motion=crossref.ListB)  # -> Geometry, Transform

# ----
# Attractors
number_slider_4 = Slider(1, range=0..10)
number_slider_5 = Slider(13, range=0..100)
multiplication_2 = Multiplication(A=number_slider_4, B="2")
series_4 = Series(Start=0, Step=multiplication_2, Count=number_slider_5)
cir_2 = Circle(Plane=PlaneXY(0, 0, 0), Radius=number_slider_4)
X_2 = UnitX(Factor=series_4)
series_5 = Series(Start=0, Step=multiplication_2, Count=number_slider_5)
move_3 = Move(Geometry=cir_2, Motion=X_2)  # -> Geometry, Transform
Y_2 = UnitY(Factor=series_5)
crossref_2 = CrossReference(ListA=move_3.Geometry, ListB=Y_2, CrossMode=1)  # -> ListA, ListB
move_4 = Move(Geometry=crossref_2.ListA, Motion=crossref_2.ListB)  # -> Geometry, Transform

# ----
# Attractors
number_slider_6 = Slider(1, range=0..10)
number_slider_7 = Slider(13, range=0..100)
multiplication_3 = Multiplication(A=number_slider_6, B="2")
series_6 = Series(Start=0, Step=multiplication_3, Count=number_slider_7)
cir_3 = Circle(Plane=PlaneXY(0, 0, 0), Radius=number_slider_6)
X_3 = UnitX(Factor=series_6)
series_7 = Series(Start=0, Step=multiplication_3, Count=number_slider_7)
move_5 = Move(Geometry=cir_3, Motion=X_3)  # -> Geometry, Transform
Y_3 = UnitY(Factor=series_7)
crossref_3 = CrossReference(ListA=move_5.Geometry, ListB=Y_3, CrossMode=1)  # -> ListA, ListB
move_6 = Move(Geometry=crossref_3.ListA, Motion=crossref_3.ListB)  # -> Geometry, Transform

# ----
# Attractors
number_slider_8 = Slider(1, range=0..10)
number_slider_9 = Slider(13, range=0..100)
multiplication_4 = Multiplication(A=number_slider_8, B="2")
series_8 = Series(Start=0, Step=multiplication_4, Count=number_slider_9)
cir_4 = Circle(Plane=PlaneXY(0, 0, 0), Radius=number_slider_8)
X_4 = UnitX(Factor=series_8)
series_9 = Series(Start=0, Step=multiplication_4, Count=number_slider_9)
move_7 = Move(Geometry=cir_4, Motion=X_4)  # -> Geometry, Transform
Y_4 = UnitY(Factor=series_9)
crossref_4 = CrossReference(ListA=move_7.Geometry, ListB=Y_4, CrossMode=1)  # -> ListA, ListB
move_8 = Move(Geometry=crossref_4.ListA, Motion=crossref_4.ListB)  # -> Geometry, Transform

# ----
# Attractors
number_slider_10 = Slider(1, range=0..10)
number_slider_11 = Slider(13, range=0..100)
multiplication_5 = Multiplication(A=number_slider_10, B="2")
series_10 = Series(Start=0, Step=multiplication_5, Count=number_slider_11)
cir_5 = Circle(Plane=PlaneXY(0, 0, 0), Radius=number_slider_10)
X_5 = UnitX(Factor=series_10)
series_11 = Series(Start=0, Step=multiplication_5, Count=number_slider_11)
move_9 = Move(Geometry=cir_5, Motion=X_5)  # -> Geometry, Transform
Y_5 = UnitY(Factor=series_11)
crossref_5 = CrossReference(ListA=move_9.Geometry, ListB=Y_5, CrossMode=1)  # -> ListA, ListB
move_10 = Move(Geometry=crossref_5.ListA, Motion=crossref_5.ListB)  # -> Geometry, Transform

# ----
# create a Point in the Rhino Window
# and Set to Container Node
pt = Point(<point referenced from the Rhino model>)
area = Area(Geometry=move_8.Geometry)  # -> Area, Centroid
dist = Distance(PointA=pt, PointB=area.Centroid)
bnd_2 = Bounds(Numbers=dist)
dom_2 = ConstructDomain(DomainStart=Slider(0.06, range=0..1), DomainEnd=Slider(0.8, range=0..1))
remap_2 = RemapNumbers(Value=dist, Source=bnd_2, Target=dom_2)  # -> Mapped, Clipped
scale = Scale(Geometry=move_8.Geometry, Center=area.Centroid, Factor=remap_2.Mapped)  # -> Geometry, Transform
boundary = BoundarySurfaces(Edges=scale.Geometry)

crv = Curve(<curve referenced from the Rhino model>)

# ----
# Create a Curve in the Rhino Window and set
# Curve Container Node
# 
# Use Curve Closest Point Node
crv_2 = Curve(<curve referenced from the Rhino model>)
area_2 = Area(Geometry=move_10.Geometry)  # -> Area, Centroid
crv_cp = CurveClosestPoint(Point=area_2.Centroid, Curve=crv_2)  # -> Point, Parameter, Distance
bnd_3 = Bounds(Numbers=crv_cp.Distance)
dom_3 = ConstructDomain(DomainStart=Slider(5, range=0..5), DomainEnd=Slider(19.63, range=0..21))
remap_3 = RemapNumbers(Value=crv_cp.Distance, Source=bnd_3, Target=dom_3)  # -> Mapped, Clipped
Z = UnitZ(Factor=remap_3.Mapped)
move_11 = Move(Geometry=area_2.Centroid, Motion=Z)  # -> Geometry, Transform
srfgrid = SurfaceFromPoints(Points=move_11.Geometry, UCount=number_slider_11, Interpolate=False)

gradient = Gradient(LowerLimit=0, UpperLimit=1, Parameter=remap_2.Mapped, stops=[0: RGB(255, 255, 255), 1: RGB(0, 0, 0)])
preview = CustomPreview(Geometry=boundary, Material=gradient)

# ----
# create a Point in the Rhino Window
# and Set to Container Node
pt_2 = Point(<point referenced from the Rhino model>)
area_3 = Area(Geometry=move_4.Geometry)  # -> Area, Centroid
dist_2 = Distance(PointA=pt_2, PointB=area_3.Centroid)

number_slider_12 = Slider(14, range=0..100)
cir_6 = Circle(Plane=pt_2, Radius=number_slider_12)
division = Division(A=dist_2, B=number_slider_12)
min = Minimum(A=division, B=Slider(0.78, range=0..1))

scale_2 = Scale(Geometry=move_4.Geometry, Center=area_3.Centroid, Factor=min)  # -> Geometry, Transform
boundary_2 = BoundarySurfaces(Edges=scale_2.Geometry)

# ----
# create two Points in the Rhino Window
# and Set to Container Node
pt_3 = Point(<point referenced from the Rhino model>)
area_4 = Area(Geometry=move_2.Geometry)  # -> Area, Centroid
dist_3 = Distance(PointA=pt_3, PointB=area_4.Centroid)
dom_4 = ConstructDomain(DomainStart=Slider(0.06, range=0..1), DomainEnd=Slider(0.8, range=0..1))

# ----
# Add/Remove Negative Node
pt_4 = Point(<point referenced from the Rhino model>)
dist_4 = Distance(PointA=pt_4, PointB=area_4.Centroid)
addition = Addition(A=dist_3, B=dist_4)
neg = Negative(Value=dom_4)

bnd_4 = Bounds(Numbers=addition)
remap_4 = RemapNumbers(Value=addition, Source=bnd_4, Target=neg)  # -> Mapped, Clipped
scale_3 = Scale(Geometry=move_2.Geometry, Center=area_4.Centroid, Factor=remap_4.Mapped)  # -> Geometry, Transform
boundary_3 = BoundarySurfaces(Edges=scale_3.Geometry)

gradient_2 = Gradient(
    LowerLimit=0,
    UpperLimit=1,
    Parameter=remap_4.Mapped,
    stops=[0: RGB(243, 57, 0), 0.1: RGB(236, 27, 60), 0.2: RGB(210, 0, 118), 0.3: RGB(103, 0, 120), 0.4: RGB(39, 72, 161), 0.5: RGB(1, 192, 229), 0.6: RGB(18, 178, 90), 0.7: RGB(79, 186, 8), 0.8: RGB(220, 237, 32), 0.9: RGB(247, 159, 20), 1: RGB(243, 57, 0)])
preview_2 = CustomPreview(Geometry=boundary_3, Material=gradient_2)

# ----
# Create a Curve in the Rhino Window and set
# Curve Container Node
# 
# Use Curve Closest Point Node
area_5 = Area(Geometry=move_6.Geometry)  # -> Area, Centroid
dom_5 = ConstructDomain(DomainStart=Slider(0.06, range=0..1), DomainEnd=Slider(0.8, range=0..1))

crv_cp_2 = CurveClosestPoint(Point=area_5.Centroid, Curve=crv)  # -> Point, Parameter, Distance

bnd_5 = Bounds(Numbers=crv_cp_2.Distance)
remap_5 = RemapNumbers(Value=crv_cp_2.Distance, Source=bnd_5, Target=dom_5)  # -> Mapped, Clipped
scale_4 = Scale(Geometry=move_6.Geometry, Center=area_5.Centroid, Factor=remap_5.Mapped)  # -> Geometry, Transform
boundary_4 = BoundarySurfaces(Edges=scale_4.Geometry)

gradient_3 = Gradient(
    LowerLimit=0,
    UpperLimit=1,
    Parameter=remap_5.Mapped,
    stops=[0: RGB(234, 38, 0), 0.25: RGB(234, 126, 0), 0.5: RGB(254, 244, 84), 0.75: RGB(173, 203, 249), 1: RGB(75, 107, 169)])
preview_3 = CustomPreview(Geometry=boundary_4, Material=gradient_3)
