# Grasshopper definition January6th2020TedeschiChapter3DiaGrid.gh (Grasshopper 1.0.7)
# plug-ins: Bifocals

# ----
# DiaGrid on any surface
number_slider = Slider(12, range=0..100)
srf = Surface(reparameterize(<surface referenced from the Rhino model>))
divide = DivideDomain²(Domain=srf, UCount=Slider(12, range=0..100), VCount=number_slider)
subsrf = Isotrim(Surface=srf, Domain=divide)
item = ListItem(List=subsrf, Index=Slider(0, range=0..10), Wrap=True)
debrep = DeconstructBrep(Brep=item)  # -> Faces, Edges, Vertices
item_2 = ListItem(List=debrep.Vertices, Index=Slider(1, range=0..10), Wrap=True)
item_3 = ListItem(List=debrep.Vertices, Index=Slider(2, range=0..10), Wrap=True)
item_4 = ListItem(List=debrep.Vertices, Index=Slider(0, range=0..10), Wrap=True)
item_5 = ListItem(List=debrep.Vertices, Index=Slider(3, range=0..10), Wrap=True)
ln = Line(StartPoint=item_3, EndPoint=item_5)
ln_2 = Line(StartPoint=item_4, EndPoint=item_2)

# ----
# Gaussian Curvature
md_slider = MDSlider(
    SliderMode=0,
    slider_value=Point(0.5878048874, 0.6170736173, 0.5),
    x_domain=Domain(0, 1),
    y_domain=Domain(0, 1),
    z_domain=Domain(0, 1))
srf_2 = Surface(reparameterize(<surface referenced from the Rhino model>))
curvature = PrincipalCurvature(Surface=srf_2, Point=md_slider)  # -> Frame, Min, Max, MinDirection, MaxDirection
curvature_2 = SurfaceCurvature(Surface=srf_2, Point=md_slider)  # -> Frame, Gaussian, Mean
pt = Point(curvature.Frame)
panel = Panel(curvature_2.Gaussian)
panel_2 = Panel(curvature_2.Mean)
amp = Amplitude(Vector=[curvature.MinDirection, curvature.MaxDirection], Amplitude=Slider(18, range=0..100))
panel_3 = Panel(curvature.Min)
panel_4 = Panel(curvature.Max)
vdis = VectorDisplay(Anchor=curvature.Frame, Vector=amp)

# ----
# Developable Test
cone = Cone(Base=PlaneXY(0, 0, 0), Radius=0.5, Length=1)  # -> Cone, Tip
sph = Sphere(Base=PlaneXY(0, 0, 0), Radius=1)
md_slider_2 = MDSlider(
    SliderMode=0,
    slider_value=Point(0.1977483238, 0.134203655, 0.5),
    x_domain=Domain(0, 1),
    y_domain=Domain(0, 1),
    z_domain=Domain(0, 1))
srf_3 = Surface(reparameterize(sph))
srf_4 = Surface(reparameterize(cone.Cone))
osc = OsculatingCircles(Surface=srf_4, Point=md_slider_2)  # -> Point, FirstCircle, SecondCircle
osc_2 = OsculatingCircles(Surface=srf_3, Point=md_slider_2)  # -> Point, FirstCircle, SecondCircle
line = Line(osc.SecondCircle)
line_2 = Line(osc.FirstCircle)
line_3 = Line(osc_2.FirstCircle)
line_4 = Line(osc_2.SecondCircle)

# ----
# DiaGrid on any surface
number_slider_2 = Slider(17, range=0..100)
srf_5 = Surface(reparameterize(<surface referenced from the Rhino model>))
divide_2 = DivideDomain²(Domain=srf_5, UCount=Slider(11, range=0..100), VCount=number_slider_2)
subsrf_2 = Isotrim(Surface=srf_5, Domain=divide_2)
debrep_2 = DeconstructBrep(Brep=subsrf_2)  # -> Faces, Edges, Vertices
item_6 = ListItem(List=debrep_2.Vertices, Index=Slider(1, range=0..10), Wrap=True)
item_7 = ListItem(List=debrep_2.Vertices, Index=Slider(2, range=0..10), Wrap=True)
item_8 = ListItem(List=debrep_2.Vertices, Index=Slider(0, range=0..10), Wrap=True)
item_9 = ListItem(List=debrep_2.Vertices, Index=Slider(3, range=0..10), Wrap=True)
ln_3 = Line(StartPoint=item_7, EndPoint=item_9)
ln_4 = Line(StartPoint=item_8, EndPoint=item_6)

sdivide = DivideSurface(Surface=srf_3, UCount=10, VCount=10)  # -> Points, Normals, Parameters
sdivide_2 = DivideSurface(Surface=srf_4, UCount=10, VCount=10)  # -> Points, Normals, Parameters
osc_3 = OsculatingCircles(Surface=srf_3, Point=sdivide.Parameters)  # -> Point, FirstCircle, SecondCircle
osc_4 = OsculatingCircles(Surface=srf_4, Point=sdivide_2.Parameters)  # -> Point, FirstCircle, SecondCircle
line_5 = Line(osc_3.FirstCircle)
line_6 = Line(osc_4.FirstCircle)
line_7 = Line(osc_3.SecondCircle)
line_8 = Line(osc_4.SecondCircle)

division = Division(A=Slider(1, range=0..1), B=Slider(100, range=0..100))
pipe = Pipe(Curve=osc_3.FirstCircle, Radius=division, Caps=0)

# ----
# SpaceFrame
md_slider_3 = MDSlider(SliderMode=0, slider_value=Point(0.5, 0.5, 0.5), x_domain=Domain(0, 1), y_domain=Domain(0, 1), z_domain=Domain(0, 1))
evalsrf = EvaluateSurface(Surface=reparameterize(debrep_2.Faces), Point=md_slider_3)  # -> Point, Normal, UDirection, VDirection, Frame
line_9 = LineSDL(Start=evalsrf.Point, Direction=evalsrf.Normal, Length=Slider(8.64, range=0..10))
end = EndPoints(Curve=line_9)  # -> Start, End
ln_5 = Line(StartPoint=end.End, EndPoint=debrep_2.Vertices)
pipe_2 = Pipe(Curve=ln_5, Radius=Slider(0.37, range=0..1), Caps=0)

panel_5 = Panel(osc_2.FirstCircle)
panel_6 = Panel(osc_2.SecondCircle)
panel_7 = Panel(osc.FirstCircle)
panel_8 = Panel(osc.SecondCircle)

srf_6 = Surface(srf_5)
project = Project(Curve=ln_4, Brep=srf_6, Direction=Vector(0, 0, 1))
project_2 = Project(Curve=ln_3, Brep=srf_6, Direction=Vector(0, 0, 1))
