# Grasshopper definition January6th2020TedeschiChapter3Surfaces.gh (Grasshopper 1.0.7)
# plug-ins: Bifocals, LunchBox

# ----
# Reverse Surface Direction (set to 1,2,or 3)
number_slider = Slider(3, range=1..3)
md_slider = MDSlider(
    SliderMode=0,
    slider_value=Point(0.6990243865, 0.6202437238, 0.5),
    x_domain=Domain(0, 1),
    y_domain=Domain(0, 1),
    z_domain=Domain(0, 1))
srf = Surface(reparameterize(<surface referenced from the Rhino model>))
revsrf = ReverseSurfaceDirection(Surface=srf, ReverseOption=number_slider)
evalsrf = EvaluateSurface(Surface=revsrf, Point=md_slider)  # -> Point, Normal, UDirection, VDirection, Frame
multiplication = Multiplication(A=evalsrf.Normal, B=Slider(45, range=0..100))
vdis = VectorDisplay(Anchor=evalsrf.Point, Vector=multiplication)

# ----
# Evaluate Surface
md_slider_2 = MDSlider(SliderMode=0, slider_value=Point(0.5, 0.5, 0.5), x_domain=Domain(0, 1), y_domain=Domain(0, 1), z_domain=Domain(0, 1))
srf_2 = Surface(reparameterize(<surface referenced from the Rhino model>))
evalsrf_2 = EvaluateSurface(Surface=srf_2, Point=md_slider_2)  # -> Point, Normal, UDirection, VDirection, Frame
pt = Point(evalsrf_2.Point)
panel = Panel(pt)

# ----
# Isotrim-Subsrf
number_slider_2 = Slider(4, range=0..10)
srf_3 = Surface(reparameterize(<surface referenced from the Rhino model>))
divide = DivideDomain²(Domain=srf_3, UCount=number_slider_2, VCount=number_slider_2)
subsrf = Isotrim(Surface=srf_3, Domain=divide)

# ----
# Uneven Splitting
number_slider_3 = Slider(6, range=0..10)
srf_4 = Surface(reparameterize(<surface referenced from the Rhino model>))
divide_2 = DivideDomain²(Domain=srf_4, UCount=number_slider_3, VCount=number_slider_3)
dedom2 = DeconstructDomain²(Domain=divide_2)  # -> UComponent, VComponent
graph = GraphMapper(
    dedom2.UComponent,
    x0=0,
    x1=1,
    y0=0,
    y1=1,
    container_name="Bezier",
    cpx=[0, 0.1346940547, 0.575163722, 1],
    cpy=[0, 0.6548205614, 0.277235806, 1])
graph_2 = GraphMapper(
    dedom2.VComponent,
    x0=0,
    x1=1,
    y0=0,
    y1=1,
    container_name="Bezier",
    cpx=[0, 0.8008289933, 0.7064328194, 1],
    cpy=[0, 0.163836062, 0.5414207578, 1])
dom² = ConstructDomain²(DomainU=graph, DomainV=graph_2)
subsrf_2 = Isotrim(Surface=srf_4, Domain=dom²)

# ----
# Isotrim-Subsrf
# Each Subsrf can be reparameterized
number_slider_4 = Slider(4, range=0..10)
srf_5 = Surface(reparameterize(<surface referenced from the Rhino model>))
divide_3 = DivideDomain²(Domain=srf_5, UCount=number_slider_4, VCount=number_slider_4)
subsrf_3 = Isotrim(Surface=srf_5, Domain=divide_3)  # -> reparameterize(Surface)

# ----
# Cull Pattern
number_slider_5 = Slider(6, range=0..10)
srf_6 = Surface(reparameterize(<surface referenced from the Rhino model>))
divide_4 = DivideDomain²(Domain=srf_6, UCount=number_slider_5, VCount=number_slider_5)
subsrf_4 = Isotrim(Surface=srf_6, Domain=divide_4)  # -> reparameterize(Surface)
merge = Merge(Data1=Toggle(True), Data2=Toggle(False), Data3=Toggle(True))
cull = CullPattern(List=subsrf_4, CullPattern=merge)

# ----
# Geodesic: The shortest line in curved space
srf_7 = Surface(reparameterize(<surface referenced from the Rhino model>))
debrep = DeconstructBrep(Brep=srf_7)  # -> Faces, Edges, Vertices
number_slider_6 = Slider(0.6, range=0..1)
item = ListItem(List=debrep.Edges, Index=Slider(0, range=0..10), Wrap=True)
item_2 = ListItem(List=debrep.Edges, Index=Slider(2, range=0..10), Wrap=True)
eval = EvaluateCurve(Curve=reparameterize(item), Parameter=number_slider_6)  # -> Point, Tangent, Angle
eval_2 = EvaluateCurve(Curve=reparameterize(item_2), Parameter=number_slider_6)  # -> Point, Tangent, Angle
geodesic = Geodesic(Surface=srf_7, Start=eval.Point, End=eval_2.Point)

# ----
# DeBrep
debrep_2 = DeconstructBrep(Brep=srf_4)  # -> Faces, Edges, Vertices
panel_2 = Panel(debrep_2.Edges)
panel_3 = Panel(debrep_2.Vertices)
panel_4 = Panel(debrep_2.Faces)

md_slider_3 = MDSlider(
    SliderMode=0,
    slider_value=Point(0.2093007157, 0.6721838974, 0.5),
    x_domain=Domain(0, 1),
    y_domain=Domain(0, 1),
    z_domain=Domain(0, 1))
item_3 = ListItem(List=subsrf_3, Index=Slider(2, range=0..10), Wrap=True)
evalsrf_3 = EvaluateSurface(Surface=item_3, Point=md_slider_3)  # -> Point, Normal, UDirection, VDirection, Frame

panel_5 = Panel(subsrf)

# ----
# Surface Split
srfsplit = SurfaceSplit(Surface=srf_7, Curves=geodesic)
item_4 = ListItem(List=srfsplit, Index=Toggle(False), Wrap=True)
debrep_3 = DeconstructBrep(Brep=item_4)  # -> Faces, Edges, Vertices
item_5 = ListItem(List=debrep_3.Edges, Index=Slider(0, range=0..10), Wrap=True)
item_6 = ListItem(List=debrep_3.Edges, Index=Slider(1, range=0..10), Wrap=True)
item_7 = ListItem(List=debrep_3.Edges, Index=Slider(2, range=0..10), Wrap=True)
item_8 = ListItem(List=debrep_3.Edges, Index=Slider(3, range=0..10), Wrap=True)
edgesrf = EdgeSurface(CurveA=item_5, CurveB=item_6, CurveC=item_7, CurveD=item_8)
panel_6 = Panel(edgesrf)

# ----
# Extracting Isocurves
md_slider_4 = MDSlider(
    SliderMode=0,
    slider_value=Point(0.4637303236, 0.5169432105, 0.5),
    x_domain=Domain(0, 1),
    y_domain=Domain(0, 1),
    z_domain=Domain(0, 1))
srf_8 = Surface(reparameterize(<surface referenced from the Rhino model>))
evalsrf_4 = EvaluateSurface(Surface=srf_8, Point=md_slider_4)  # -> Point, Normal, UDirection, VDirection, Frame
multiplication_2 = Multiplication(A=evalsrf_4.Normal, B=Slider(45, range=0..100))

iso = IsoCurve(Surface=srf_8, UVPoint=md_slider_4)  # -> UIsocurve, VIsocurve
pt_2 = Point(evalsrf_4.Point)

vdis_2 = VectorDisplay(Anchor=pt_2, Vector=multiplication_2)
