# Grasshopper definition January6th2020TedeschiChapter4TransformationsAffineGraphMapper.gh (Grasshopper 1.0.7)
# plug-ins: Bifocals

# ----
# Graphmapper used in Move Series
number_slider = Slider(39, range=0..100)
number_slider_2 = Slider(0, range=0..100)
crv = Curve(<curve referenced from the Rhino model>)
subtraction = Subtraction(A=number_slider, B="1")
series = Series(Start=number_slider_2, Step=Slider(3, range=0..10), Count=number_slider)
division = Division(A=Slider(0.89, range=0..10), B=subtraction)
Z = UnitZ(Factor=series)
pi = Pi(Factor=division)
dom = ConstructDomain(DomainStart=Slider(1, range=0..1), DomainEnd=Slider(10, range=0..10))
move = Move(Geometry=crv, Motion=Z)  # -> Geometry, Transform
subtraction_2 = Subtraction(A=number_slider, B="1")
area = Area(Geometry=crv)  # -> Area, Centroid
series_2 = Series(Start=number_slider_2, Step=pi, Count=number_slider)
range = Range(Domain=number_slider, Steps=subtraction_2)
line = LineSDL(Start=area.Centroid, Direction=Z, Length=1)
rotax = RotateAxis(Geometry=move.Geometry, Angle=series_2, Axis=line)  # -> Geometry, Transform
graph = GraphMapper(
    range,
    x0=1,
    x1=10,
    y0=0,
    y1=1.3,
    container_name="Bezier",
    cpx=[0, 0.4056639671, 0.7125665545, 1],
    cpy=[0.6110141277, 1, 0.3153624535, 0.6110141277])
area_2 = Area(Geometry=rotax.Geometry)  # -> Area, Centroid
scale = Scale(Geometry=rotax.Geometry, Center=area_2.Centroid, Factor=graph)  # -> Geometry, Transform

# ----
# Move and Scale in Series
number_slider_3 = Slider(10, range=0..10)
box = CenterBox(Base=PlaneXY(0, 0, 0), X=1, Y=1, Z=1)
series_3 = Series(Start=0, Step=number_slider_3, Count=10)
Z_2 = UnitZ(Factor=series_3)
move_2 = Move(Geometry=box, Motion=Z_2)  # -> Geometry, Transform
lng = ListLength(List=move_2.Geometry)
volume = Volume(Geometry=move_2.Geometry)  # -> Volume, Centroid
series_4 = Series(Start=Slider(1.36, range=0..10), Step=Slider(1, range=0..1), Count=lng)
scale_2 = Scale(Geometry=move_2.Geometry, Center=volume.Centroid, Factor=series_4)  # -> Geometry, Transform

# ----
# Scaling with Function
# 
# Create a Series of flat cylinders in the Rhino Window
# and Set Geometry
geo = Geometry([<brep referenced from the Rhino model> x9])
dom_2 = ConstructDomain(DomainStart=Slider(1, range=0..1), DomainEnd=Slider(9, range=0..10))
volume_2 = Volume(Geometry=geo)  # -> Volume, Centroid
lng_2 = ListLength(List=geo)
subtraction_3 = Subtraction(A=lng_2, B="1")
range_2 = Range(Domain=dom_2, Steps=subtraction_3)
eval = Evaluate(F="-(1/10)*x^2+x+1", x=range_2)
scale_3 = Scale(Geometry=geo, Center=volume_2.Centroid, Factor=eval)  # -> Geometry, Transform

# ----
# Graphmapper Component (NOTE Internal Demains must be set in the Graphmapper
# domain A must be set according to Construct Domain)
number_slider_4 = Slider(1, range=0..1)
lng_3 = ListLength(List=geo)
dom_3 = ConstructDomain(DomainStart=number_slider_4, DomainEnd=Slider(9, range=0..10))
subtraction_4 = Subtraction(A=lng_3, B="1")
volume_3 = Volume(Geometry=geo)  # -> Volume, Centroid
range_3 = Range(Domain=dom_3, Steps=subtraction_4)
graph_2 = GraphMapper(
    range_3,
    x0=1,
    x1=9,
    y0=1,
    y1=4,
    container_name="Bezier",
    cpx=[0, 0.4153650105, 0.3065214753, 1],
    cpy=[0.04611694813, 0.19135952, 0.8536693454, 1])
scale_4 = Scale(Geometry=geo, Center=volume_3.Centroid, Factor=graph_2)  # -> Geometry, Transform
panel = Panel(graph_2)

loft = Loft(Curves=scale.Geometry, Options={Adjust=False, Closed=False, LoftEnds=0, LoftSimp=0, LoftType=0, Rebuild=10, Refit=0.01})
