# Grasshopper definition January6th2020TedeschiChapter4TransformationsEuclidean.gh (Grasshopper 1.0.7)
# plug-ins: Bifocals

# ----
# Rotate on Axis with Series Component
number_slider = Slider(0.306, range=0..1)
number_slider_2 = Slider(10, range=0..10)
series = Series(Start=Slider(0, range=0..100), Step=Slider(4, range=0..10), Count=Slider(10, range=0..10))
box = CenterBox(Base=PlaneXY(0, 0, 0), X=number_slider_2, Y=number_slider_2, Z=number_slider)
Z = UnitZ(Factor=1)
volume = Volume(Geometry=box)  # -> Volume, Centroid
pi = Pi(Factor=Slider(0.1, range=0..2))
Z_2 = UnitZ(Factor=series)
move = Move(Geometry=box, Motion=Z_2)  # -> Geometry, Transform
series_2 = Series(Start=0, Step=pi, Count=10)
line = LineSDL(Start=volume.Centroid, Direction=Z, Length=1)
rotax = RotateAxis(Geometry=move.Geometry, Angle=series_2, Axis=line)  # -> Geometry, Transform

number_slider_3 = Slider(6, range=0..10)

addition = Addition(A=number_slider_3, B=Slider(1, range=0..1))
series_3 = Series(Start=Slider(0, range=0..10), Step=number_slider_3, Count=addition)

# ----
# Rotation
number_slider_4 = Slider(6, range=0..10)
box_2 = CenterBox(Base=PlaneXY(0, 0, 0), X=1, Y=1, Z=1)
md_slider = MDSlider(
    SliderMode=0,
    slider_value=Point(0.471305568, 0.4713052889, 0.5),
    x_domain=Domain(0, 1),
    y_domain=Domain(0, 1),
    z_domain=Domain(0, 1))
debrep = DeconstructBrep(Brep=box_2)  # -> Faces, Edges, Vertices
item = ListItem(List=debrep.Faces, Index=number_slider_4, Wrap=True)
evalsrf = EvaluateSurface(Surface=reparameterize(item), Point=md_slider)  # -> Point, Normal, UDirection, VDirection, Frame
pl = PlaneNormal(Origin=evalsrf.Point, ZAxis=evalsrf.Normal)
pi_2 = Pi(Factor=Slider(0, range=0..2))
rotate = Rotate(Geometry=box_2, Angle=pi_2, Plane=pl)  # -> Geometry, Transform

# ----
# Rotate Axis and Move
number_slider_5 = Slider(0, range=0..100)
number_slider_6 = Slider(17, range=0..100)
subtraction = Subtraction(A=number_slider_6, B="1")
series_4 = Series(Start=number_slider_5, Step=Slider(2, range=0..10), Count=number_slider_6)
crv = Curve(<curve referenced from the Rhino model>)
division = Division(A=Slider(-0.35, range=-2..2.01), B=subtraction)
Z_3 = UnitZ(Factor=series_4)
pi_3 = Pi(Factor=division)
area = Area(Geometry=crv)  # -> Area, Centroid
move_2 = Move(Geometry=crv, Motion=Z_3)  # -> Geometry, Transform
series_5 = Series(Start=number_slider_5, Step=pi_3, Count=number_slider_6)
line_2 = LineSDL(Start=area.Centroid, Direction=Z_3, Length=1)
rotax_2 = RotateAxis(Geometry=move_2.Geometry, Angle=series_5, Axis=line_2)  # -> Geometry, Transform
loft = Loft(
    Curves=rotax_2.Geometry,
    Options={Adjust=False, Closed=False, LoftEnds=0, LoftSimp=0, LoftType=0, Rebuild=10, Refit=0.01})

# ----
# move
number_slider_7 = Slider(2, range=0..10)
box_3 = CenterBox(Base=PlaneXY(0, 0, 0), X=1, Y=1, Z=1)
Z_4 = UnitZ(Factor=series_3)
move_3 = Move(Geometry=box_3, Motion=Z_4)  # -> Geometry, Transform

# ----
# Orient
md_slider_2 = MDSlider(SliderMode=0, slider_value=Point(0.5, 0.5, 0.5), x_domain=Domain(0, 1), y_domain=Domain(0, 1), z_domain=Domain(0, 1))
srf = Surface(reparameterize(<surface referenced from the Rhino model>))
evalsrf_2 = EvaluateSurface(Surface=reparameterize(srf), Point=md_slider_2)  # -> Point, Normal, UDirection, VDirection, Frame
pt = Point(<point referenced from the Rhino model>)
yz = YZPlane(Origin=pt)
xz = XZPlane(Origin=pt)
xy = XYPlane(Origin=pt)
orient = Orient(Geometry=srf, Source=evalsrf_2.Frame, Target=xy)  # -> Geometry, Transform

# ----
# Orient Multiple Surfaces to XY Plane for
# Fabrication CNC
md_slider_3 = MDSlider(
    SliderMode=0,
    slider_value=Point(0.5015969016, 0.4971804735, 0.5),
    x_domain=Domain(0, 1),
    y_domain=Domain(0, 1),
    z_domain=Domain(0, 1))
srf_2 = Surface(reparameterize([<surface referenced from the Rhino model> x11]))
lng = ListLength(List=srf_2)
series_6 = Series(Start=0, Step=Slider(100, range=0..100), Count=lng)
evalsrf_3 = EvaluateSurface(Surface=srf_2, Point=md_slider_3)  # -> Point, Normal, UDirection, VDirection, Frame
pt_2 = Point(<point referenced from the Rhino model>)
Y = UnitY(Factor=series_6)
neg = Negative(Value=evalsrf_3.Normal)
move_4 = Move(Geometry=pt_2, Motion=Y)  # -> Geometry, Transform
pl_2 = PlaneNormal(Origin=evalsrf_3.Point, ZAxis=neg)
xy_2 = XYPlane(Origin=move_4.Geometry)
orient_2 = Orient(Geometry=srf_2, Source=pl_2, Target=xy_2)  # -> Geometry, Transform

loft_2 = Loft(
    Curves=rotax_2.Geometry,
    Options={Adjust=False, Closed=False, LoftEnds=0, LoftSimp=0, LoftType=0, Rebuild=10, Refit=0.01})

# ----
# Rotation
number_slider_8 = Slider(6, range=0..10)
box_4 = CenterBox(Base=PlaneXY(0, 0, 0), X=1, Y=1, Z=1)
md_slider_4 = MDSlider(SliderMode=0, slider_value=Point(1, 1, 0.5), x_domain=Domain(0, 1), y_domain=Domain(0, 1), z_domain=Domain(0, 1))
debrep_2 = DeconstructBrep(Brep=box_4)  # -> Faces, Edges, Vertices
item_2 = ListItem(List=debrep_2.Faces, Index=number_slider_8, Wrap=True)
evalsrf_4 = EvaluateSurface(Surface=reparameterize(item_2), Point=md_slider_4)  # -> Point, Normal, UDirection, VDirection, Frame
pi_4 = Pi(Factor=Slider(1.13, range=0..2))

line_3 = LineSDL(Start=evalsrf_4.Point, Direction=evalsrf_4.Normal, Length=1)

rotax_3 = RotateAxis(Geometry=box_4, Angle=pi_4, Axis=line_3)  # -> Geometry, Transform

# ----
# Amplitude and Scalar
# Multiplication
pt_3 = Point(<point referenced from the Rhino model>)
pt_4 = Point(<point referenced from the Rhino model>)
number_slider_9 = Slider(2.2, range=0..10)
vec2pt = Vector2Pt(PointA=pt_3, PointB=pt_4, Unitize=False)  # -> Vector, Length
panel = Panel(vec2pt.Length)
vdis = VectorDisplay(Anchor=pt_3, Vector=vec2pt.Vector)

multiplication = Multiplication(A=vec2pt.Vector, B=number_slider_9)
amp = Amplitude(Vector=vec2pt.Vector, Amplitude=number_slider_9)

vlen = VectorLength(Vector=multiplication)
vlen_2 = VectorLength(Vector=amp)
panel_2 = Panel(vlen)
vdis_2 = VectorDisplay(Anchor=pt_3, Vector=multiplication)
panel_3 = Panel(vlen_2)
