# Grasshopper definition January6th2020TedeschiChapter4TransformationsSurfaceBoxMorph.gh (Grasshopper 1.0.7)
# plug-ins: Bifocals

# ----
# Image Sampler Black and White .jpg
# Create a surface and a matrix of points in Rhino
#  Window and set to points and surface
# container nodes in Grasshopper
srf = Surface(reparameterize(<surface referenced from the Rhino model>))
pt = Point([<point referenced from the Rhino model> x625])
srf_cp = SurfaceClosestPoint(Point=pt, Surface=srf)  # -> Point, UVPoint, Distance
image = ImageSampler(
    srf_cp.UVPoint,
    FilePath="C:\Users\Sculpture\Desktop\ScreenShots2019\BlackAndWhiteSharpImageSampler.PNG",
    Filter="Value",
    Interpolate=False,
    Umax=1,
    Umin=0,
    Vmax=1,
    Vmin=0,
    Wrap=1)
evalsrf = EvaluateSurface(Surface=srf, Point=srf_cp.UVPoint)  # -> Point, Normal, UDirection, VDirection, Frame
circle = CircleCNR(Center=pt, Normal=evalsrf.Normal, Radius=Slider(5, range=0..10))
max = Maximum(A=image, B=Slider(0.1, range=0..1))
scale = Scale(Geometry=circle, Center=evalsrf.Point, Factor=max)  # -> Geometry, Transform

# ----
# Color Mapping a Terrain from Image Samply
# 
# Create matrix grid of points and free form surface in Rhino Window
# 
# Set to node in Grasshopper and upload an image
srf_2 = Surface(reparameterize(<surface referenced from the Rhino model>))
pt_2 = Point([<point referenced from the Rhino model> x625])
srf_cp_2 = SurfaceClosestPoint(Point=pt_2, Surface=srf_2)  # -> Point, UVPoint, Distance
image_2 = ImageSampler(
    srf_cp_2.UVPoint,
    FilePath="C:\Users\Sculpture\Desktop\ScreenShots2019\2020Renders\January7th2020WickersonStudiosExtrudedCurvaturePattern.jpg",
    Filter="Colour",
    Interpolate=False,
    Umax=1,
    Umin=0,
    Vmax=1,
    Vmin=0,
    Wrap=1)
image_3 = ImageSampler(
    srf_cp_2.UVPoint,
    FilePath="C:\Users\Sculpture\Documents\UMKC\RhinoFilesEScholar\PT002.jpg",
    Filter="Colour",
    Interpolate=False,
    Umax=1,
    Umin=0,
    Vmax=1,
    Vmin=0,
    Wrap=1)
number_slider = Slider(100, range=0..100)
argb = SplitARGB(Colour=image_2)  # -> Alpha, Red, Green, Blue
panel = Panel(argb.Red)
multiplication = Multiplication(A=argb.Red, B=Slider(20, range=0..20))
addition = Addition(A=multiplication, B=Slider(10, range=0..10))
Z = UnitZ(Factor=addition)
move = Move(Geometry=srf_cp_2.Point, Motion=Z)  # -> Geometry, Transform
srf_3 = Surface(reparameterize(<surface referenced from the Rhino model>))
srfgrid = SurfaceFromPoints(Points=move.Geometry, UCount=Slider(25, range=0..100), Interpolate=False)
wires = BrepWireframe(Brep=srf_3, Density=-1)
wires_2 = BrepWireframe(Brep=srfgrid, Density=-1)
explode = Explode(Curve=wires, Recursive=True)  # -> flatten(Segments), Vertices
explode_2 = Explode(Curve=wires_2, Recursive=True)  # -> flatten(Segments), Vertices
number_slider_2 = Slider(3, range=0..3)
number_slider_3 = Slider(1, range=0..3)
number_slider_4 = Slider(2, range=0..3)
number_slider_5 = Slider(0, range=0..3)
item = ListItem(List=explode_2.Segments, Index=number_slider_2, Wrap=True)
item_2 = ListItem(List=explode.Segments, Index=number_slider_2, Wrap=True)
item_3 = ListItem(List=explode_2.Segments, Index=number_slider_3, Wrap=True)
item_4 = ListItem(List=explode.Segments, Index=number_slider_3, Wrap=True)
item_5 = ListItem(List=explode_2.Segments, Index=number_slider_4, Wrap=True)
item_6 = ListItem(List=explode.Segments, Index=number_slider_4, Wrap=True)
item_7 = ListItem(List=explode_2.Segments, Index=number_slider_5, Wrap=True)
item_8 = ListItem(List=explode.Segments, Index=number_slider_5, Wrap=True)
loft = Loft(Curves=[item, item_2], Options={Adjust=False, Closed=False, LoftEnds=0, LoftSimp=0, LoftType=0, Rebuild=10, Refit=0.01})
loft_2 = Loft(
    Curves=[item_3, item_4],
    Options={Adjust=False, Closed=False, LoftEnds=0, LoftSimp=0, LoftType=0, Rebuild=10, Refit=0.01})
loft_3 = Loft(
    Curves=[item_5, item_6],
    Options={Adjust=False, Closed=False, LoftEnds=0, LoftSimp=0, LoftType=0, Rebuild=10, Refit=0.01})
loft_4 = Loft(
    Curves=[item_7, item_8],
    Options={Adjust=False, Closed=False, LoftEnds=0, LoftSimp=0, LoftType=0, Rebuild=10, Refit=0.01})
merge = Merge(Data1=loft_4, Data2=loft_2, Data3=loft_3, Data4=loft, Data5=srfgrid, Data6=srf_3)
join = BrepJoin(Breps=merge)  # -> Breps, Closed

# ----
# Box Morph
number_slider_6 = Slider(12, range=0..100)
sph = Sphere(Base=PlaneXY(0, 0, 0), Radius=number_slider_6)
bbox = BoundingBox(Content=sph, Plane=PlaneXY(0, 0, 0))  # -> Box, Box_2
box = CenterBox(Base=PlaneXY(0, 0, 0), X=number_slider_6, Y=number_slider_6, Z=Slider(45, range=0..100))
morph = BoxMorph(Geometry=sph, Reference=bbox.Box, Target=box)

# ----
# Color Image Sampler
srf_4 = Surface(reparameterize(<surface referenced from the Rhino model>))
pt_3 = Point([<point referenced from the Rhino model> x625])
srf_cp_3 = SurfaceClosestPoint(Point=pt_3, Surface=srf_4)  # -> Point, UVPoint, Distance
image_4 = ImageSampler(
    srf_cp_3.UVPoint,
    FilePath="C:\Users\Sculpture\Documents\UMKC\RhinoFilesEScholar\PT002.jpg",
    Filter="Colour",
    Interpolate=False,
    Umax=1,
    Umin=0,
    Vmax=1,
    Vmin=0,
    Wrap=1)
argb_2 = SplitARGB(Colour=image_4)  # -> Alpha, Red, Green, Blue
argb_3 = SplitARGB(Colour=image_4, IntegerChannels=True)  # -> Alpha, Red, Green, Blue
panel_2 = Panel(argb_3.Green)
panel_3 = Panel(image_4)
panel_4 = Panel(argb_2.Green)

# ----
# Twisted Box Morph
pt_4 = Point(<point referenced from the Rhino model>)
pt_5 = Point(<point referenced from the Rhino model>)
pt_6 = Point(<point referenced from the Rhino model>)
pt_7 = Point(<point referenced from the Rhino model>)
pt_8 = Point(<point referenced from the Rhino model>)
pt_9 = Point(<point referenced from the Rhino model>)
pt_10 = Point(<point referenced from the Rhino model>)
pt_11 = Point(<point referenced from the Rhino model>)
tbox = TwistedBox(CornerA=pt_4, CornerB=pt_5, CornerC=pt_6, CornerD=pt_7, CornerE=pt_8, CornerF=pt_9, CornerG=pt_10, CornerH=pt_11)
morph_2 = BoxMorph(Geometry=sph, Reference=bbox.Box, Target=tbox)

boundary = BoundarySurfaces(Edges=scale.Geometry)

dom = ConstructDomain(DomainStart=Slider(-29, range=-100..101), DomainEnd=Slider(92, range=0..100))

# ----
# Paneling with Surface Box Morph Node
number_slider_7 = Slider(20, range=0..100)
number_slider_8 = Slider(60, range=0..100)
srf_5 = Surface(reparameterize(<surface referenced from the Rhino model>))
geo = Geometry(<brep referenced from the Rhino model>)
divide = DivideDomain²(Domain=srf_5, UCount=number_slider_7, VCount=number_slider_7)
bbox_2 = BoundingBox(Content=geo, Plane=PlaneXY(0, 0, 0))  # -> Box, Box_2

lng = ListLength(List=divide)
random = Random(Range=dom, Number=lng, Seed=2)

sbox = SurfaceBox(Surface=srf_5, Domain=divide, Height=random)
morph_3 = BoxMorph(Geometry=geo, Reference=bbox_2.Box, Target=sbox)
