# Grasshopper definition January9tth2020TedeschiChapter5AdvancedDataManager.gh (Grasshopper 1.0.7)
# plug-ins: Bifocals

# ----
# Data Items/Data Paths
# 
# Create several copies of a surface in Rhino and set to Grasshopper Geo
geo = Geometry([<brep referenced from the Rhino model> x7])
debrep = DeconstructBrep(Brep=geo)  # -> Faces, Edges, Vertices
pline = PolyLine(Vertices=debrep.Vertices, Closed=False)
panel = Panel(pline)
panel_2 = Panel(debrep.Vertices)

srf = Surface(<surface referenced from the Rhino model>)
srf_2 = Surface(<surface referenced from the Rhino model>)
debrep_2 = DeconstructBrep(Brep=srf_2)  # -> Faces, Edges, Vertices
debrep_3 = DeconstructBrep(Brep=srf)  # -> Faces, Edges, Vertices
merge = Merge(Data1=debrep_3.Edges, Data2=debrep_2.Edges)
loft = Loft(Curves=merge, Options={Adjust=False, Closed=False, LoftEnds=0, LoftSimp=0, LoftType=0, Rebuild=10, Refit=0.01})

# ----
# Flip Matrix
# 
# Create Three curves in Rhino Window and Set to Greasshopper
crv = Curve([<curve referenced from the Rhino model> x3])
divide = DivideCurve(Curve=crv, Count=10, Kinks=False)  # -> Points, Tangents, Parameters
viewer = ParamViewer(divide.Points)
panel_3 = Panel(divide.Points)
flip = FlipMatrix(Data=divide.Points)
viewer_2 = ParamViewer(divide.Points)
panel_4 = Panel(flip)
pline_2 = PolyLine(Vertices=flip, Closed=False)

flatten = FlattenTree(Tree=debrep.Vertices, Path="{0}")
panel_5 = Panel(flatten)
unflatten = UnflattenTree(Tree=flatten, Guide=debrep.Vertices)
panel_6 = Panel(unflatten)

graft = GraftTree(Tree=flatten, IncludeEmptyLists=True, IncludeNullItems=True)
panel_7 = Panel(graft)

# ----
# Loft/Graft/Loft Again
graft_2 = GraftTree(Tree=debrep_3.Edges, IncludeEmptyLists=True, IncludeNullItems=True)
graft_3 = GraftTree(Tree=debrep_2.Edges, IncludeEmptyLists=True, IncludeNullItems=True)
merge_2 = Merge(Data1=graft_2, Data2=graft_3)
loft_2 = Loft(Curves=merge_2, Options={Adjust=False, Closed=False, LoftEnds=0, LoftSimp=0, LoftType=0, Rebuild=10, Refit=0.01})
