# Grasshopper definition January9tth2020TedeschiChapter5Skins002.gh (Grasshopper 1.0.7)
# plug-ins: Bifocals

number_slider = Slider(60, range=-60..60)
pt = ConstructPoint(XCoordinate=number_slider, YCoordinate=number_slider, ZCoordinate=number_slider)

# ----
# Isotrim set surface from created surface in Rhino Window
srf = Surface(reparameterize(<surface referenced from the Rhino model>))
divide = DivideDomain²(Domain=srf, UCount=Slider(5, range=0..10), VCount=Slider(10, range=0..10))
subsrf = Isotrim(Surface=srf, Domain=divide)
debrep = DeconstructBrep(Brep=subsrf)  # -> Faces, Edges, Vertices
srf_2 = Surface(debrep.Faces)
crv = Curve(debrep.Edges)

# ----
# Offset Curves Loose
number_slider_2 = Slider(0.64, range=0..1)
join = JoinCurves(Curves=crv, Preserve=False)

neg = Negative(Value=number_slider_2)

dom = ConstructDomain(DomainStart=Slider(0.17, range=0..3), DomainEnd=Slider(10, range=0..10))

# ----
# Pyramidal Frustums
srf_3 = Surface(srf_2)
md_slider = MDSlider(
    SliderMode=0,
    slider_value=Point(0.5975609756, 0.5975609756, 0.5),
    x_domain=Domain(0, 1),
    y_domain=Domain(0, 1),
    z_domain=Domain(0, 1))
evalsrf = EvaluateSurface(Surface=reparameterize(srf_3), Point=md_slider)  # -> Point, Normal, UDirection, VDirection, Frame
pt_2 = Point(evalsrf.Point)
multiplication = Multiplication(A=evalsrf.Normal, B=Slider(-3.93, range=-10..10.01))

pt_3 = Point(pt_2)
dist = Distance(PointA=pt_3, PointB=pt)  # -> flatten(Distance)
bnd = Bounds(Numbers=dist)
remap = RemapNumbers(Value=dist, Source=bnd, Target=dom)  # -> graft(Mapped), Clipped

# ----
# an attractor Point  with X axis control slider
neg_2 = Negative(Value=remap.Mapped)

offset_l = OffsetCurveLoose(Curve=join, Distance=neg_2, Plane=srf_2)
crv_2 = Curve(offset_l)

explode = Explode(Curve=crv_2, Recursive=True)  # -> Segments, Vertices
crv_3 = Curve(explode.Segments)

# ----
# Data Path is Simplified
panel = Panel(crv)
simplify = SimplifyTree(Tree=crv_3, Front=False)
simplify_2 = SimplifyTree(Tree=crv, Front=False)
panel_2 = Panel(simplify_2)

merge = Merge(Data1=graft(simplify), Data2=graft(simplify_2))
panel_3 = Panel(merge)
loft = Loft(Curves=merge, Options={Adjust=False, Closed=False, LoftEnds=0, LoftSimp=0, LoftType=0, Rebuild=10, Refit=0.01})

crv_4 = Curve(crv_3)
scale = Scale(Geometry=crv_4, Center=pt_2, Factor=Slider(0.4, range=0..1))  # -> Geometry, Transform
move = Move(Geometry=scale.Geometry, Motion=multiplication)  # -> Geometry, Transform
crv_5 = Curve(move.Geometry)
merge_2 = Merge(Data1=graft(crv_4), Data2=graft(crv_5))
loft_2 = Loft(Curves=merge_2, Options={Adjust=False, Closed=False, LoftEnds=0, LoftSimp=0, LoftType=0, Rebuild=10, Refit=0.01})

item = ListItem(List=crv_5, Index=0, Wrap=True)  # -> Item, Item1, Item2, Item3, Item4
edgesrf = EdgeSurface(CurveA=item.Item1, CurveB=item.Item2, CurveC=item.Item3, CurveD=item.Item4)

panel_4 = Panel(edgesrf)
panel_5 = Panel(loft_2)
geo = Geometry([loft_2, edgesrf, loft])
