# Grasshopper definition January9tth2020TedeschiChapter5SkinsWeaving.gh (Grasshopper 1.0.7)
# plug-ins: Bifocals

sph = Sphere(Base=PlaneXY(0, 0, 0), Radius=Slider(36, range=0..100))  # -> reparameterize(Sphere)

# ----
# Weave Pattern
# 
# Moving pts up and down at the same time
number_slider = Slider(14, range=0..100)
srf = Surface(reparameterize(<surface referenced from the Rhino model>))
number_slider_2 = Slider(3, range=0..10)
sdivide = DivideSurface(Surface=sph, UCount=Slider(24, range=0..100), VCount=number_slider)  # -> Points, Normals, Parameters
neg = Negative(Value=number_slider_2)
viewer = ParamViewer(sdivide.Points)
merge = Merge(Data1=number_slider_2, Data2=neg)

pt_1 = Point(sdivide.Points)
flip = FlipMatrix(Data=pt_1)
pt_2 = Point(flatten(flip))

pt_1_2 = Point(flatten(sdivide.Points))
number_slider_3 = Slider(0.46, range=0..1)

lng = ListLength(List=pt_1_2)
repeat = RepeatData(Data=merge, Length=lng)
multiplication = Multiplication(A=flatten(sdivide.Normals), B=repeat)
move = Move(Geometry=pt_1_2, Motion=multiplication)  # -> Geometry, Transform

neg_2 = Negative(Value=multiplication)
pt = Point(flatten(pt_1_2))
move_2 = Move(Geometry=pt_2, Motion=neg_2)  # -> Geometry, Transform
unflatten = UnflattenTree(Tree=move_2.Geometry, Guide=flip)
intcrv = Interpolate(Vertices=unflatten, Degree=3, Periodic=False, KnotStyle=1)  # -> Curve, Length, Domain
pipe = Pipe(Curve=intcrv.Curve, Radius=number_slider_3, Caps=0)

unflatten_2 = UnflattenTree(Tree=move.Geometry, Guide=sdivide.Points)
panel = Panel(unflatten_2)
panel_2 = Panel(move.Geometry)
viewer_2 = ParamViewer(panel)
viewer_3 = ParamViewer(panel_2)
intcrv_2 = Interpolate(Vertices=unflatten_2, Degree=3, Periodic=False, KnotStyle=1)  # -> Curve, Length, Domain
pipe_2 = Pipe(Curve=intcrv_2.Curve, Radius=number_slider_3, Caps=0)

merge_2 = Merge(Data1=pipe_2, Data2=pipe)
geo = Geometry(merge_2)
