# Grasshopper definition January9tth2020TedeschiChapter5SkinsWeavingNetworkSyurfaces.gh (Grasshopper 1.0.7)
# plug-ins: Bifocals

# ----
# Woven and Network Surfaces!
number_slider = Slider(12, range=0..100)
srf = Surface(reparameterize(<surface referenced from the Rhino model>))
number_slider_2 = Slider(0.5, range=0..1)
sdivide = DivideSurface(Surface=srf, UCount=number_slider, VCount=Slider(12, range=0..100))  # -> Points, Normals, Parameters
neg = Negative(Value=number_slider_2)
pt = Point(sdivide.Points)
pt_2 = Point(flatten(sdivide.Points))
pt_3 = Point(sdivide.Points)
merge = Merge(Data1=number_slider_2, Data2=neg)
flip = FlipMatrix(Data=pt)
lng = ListLength(List=pt_2)
pt_4 = Point(flatten(flip))
repeat = RepeatData(Data=merge, Length=lng)
multiplication = Multiplication(A=flatten(sdivide.Normals), B=repeat)
neg_2 = Negative(Value=multiplication)
move = Move(Geometry=pt_2, Motion=multiplication)  # -> Geometry, Transform
move_2 = Move(Geometry=pt_4, Motion=neg_2)  # -> Geometry, Transform
unflatten = UnflattenTree(Tree=move_2.Geometry, Guide=flip)
unflatten_2 = UnflattenTree(Tree=move.Geometry, Guide=pt_3)
intcrv = Interpolate(Vertices=unflatten, Degree=3, Periodic=False, KnotStyle=1)  # -> Curve, Length, Domain
intcrv_2 = Interpolate(Vertices=unflatten_2, Degree=3, Periodic=False, KnotStyle=1)  # -> Curve, Length, Domain
merge_2 = Merge(Data1=intcrv_2.Curve, Data2=intcrv.Curve)
geo = Geometry(merge_2)

netsurf = NetworkSurface(CurvesU=flatten(intcrv_2.Curve), CurvesV=flatten(intcrv.Curve), Continuity=2)
pipe = Pipe(Curve=geo, Radius=Slider(0.15, range=0..1), Caps=0)
merge_3 = Merge(Data1=pipe, Data2=netsurf)
geo_2 = Geometry(merge_3)
