# Grasshopper definition January9tth2020TedeschiChapter6SmoothnessByConversionFromNURBS.gh (Grasshopper 1.0.7)
# plug-ins: Bifocals

# ----
# NURBS to Mesh Conversion
number_slider = Slider(5, range=0..10)
srf = Surface(reparameterize(<surface referenced from the Rhino model>))
mesh_uv = MeshSurface(Surface=srf, UCount=Slider(5, range=0..10), VCount=number_slider, Overhang=True, Equalize=False)
panel = Panel(mesh_uv)

srf_2 = Surface(reparameterize(<surface referenced from the Rhino model>))
mesh_uv_2 = MeshSurface(Surface=srf_2, UCount=Slider(5, range=0..10), VCount=Slider(5, range=0..10), Overhang=True, Equalize=False)
tri = Triangulate(Mesh=mesh_uv_2)  # -> Mesh, Count
panel_2 = Panel(tri.Mesh)

# ----
# Test for Plararity
number_slider_2 = Slider(5, range=0..10)
srf_3 = Surface(reparameterize(<surface referenced from the Rhino model>))
mesh_uv_3 = MeshSurface(Surface=srf_3, UCount=Slider(5, range=0..10), VCount=number_slider_2, Overhang=True, Equalize=False)
faceb = FaceBoundaries(Mesh=mesh_uv_3)
planar = Planar(Curve=faceb)  # -> Planar, Plane, Deviation
boundary = BoundarySurfaces(Edges=faceb)
panel_3 = Panel(planar.Planar)

# ----
# Specify Topology
# or use Join Mesh
# and Weld component
# in WeaverBird Plug-in
srf_4 = Surface(reparameterize(srf_3))
divide = DivideDomain²(Domain=srf_4, UCount=10, VCount=10)
subsrf = Isotrim(Surface=srf_4, Domain=divide)
quad = MeshQuad(
    CornerA=Slider(0, range=0..10),
    CornerB=Slider(1, range=0..10),
    CornerC=Slider(2, range=0..10),
    CornerD=Slider(3, range=0..10))
debrep = DeconstructBrep(Brep=subsrf)  # -> Faces, Edges, Vertices
conmesh = ConstructMesh(Vertices=debrep.Vertices, Faces=quad)
mjoin = MeshJoin(Meshes=flatten(conmesh))
panel_4 = Panel(debrep.Vertices)
panel_5 = Panel(mjoin)
