# Grasshopper definition January9tth2020TedeschiChapter6SmoothnessFadingPattern.gh (Grasshopper 1.0.7)
# plug-ins: MeshEdit Components, Bifocals, LunchBox, Weaverbird

# ----
# Bonus
# 
# Cull Adjacent Faces of Mesh-Boxes
# 
# strategy:cull coincident points
#  and gives index of
#  non-overlapped faces
mbox = MeshBox(Base={Plane=PlaneXY(0, 0, 0), X=Domain(-10, 10), Y=Domain(-10, 10), Z=Domain(-10, 10)}, XCount=10, YCount=10, ZCount=10)
explode = MeshExplode(Mesh=mbox, Interpolate=False)
area = Area(Geometry=flatten(explode))  # -> Area, Centroid
cullpt = CullDuplicates(Points=area.Centroid, Tolerance=Slider(0.1, range=0..1), CullMode=3)  # -> Points, Indices, Valence
panel = Panel(cullpt.Indices)
eval = Evaluate(F="x>=0", x=cullpt.Indices)
cull = CullPattern(List=cullpt.Indices, CullPattern=eval)
item = ListItem(List=flatten(explode), Index=cull, Wrap=True)
mjoin = MeshJoin(Meshes=item)

# ----
# SubDivision with ImageSampler
number_slider = Slider(48, range=0..100)
srf = Surface(reparameterize(<surface referenced from the Rhino model>))
diamond = DiamondPanels(Surface=srf, UDivisions=number_slider, VDivisions=Slider(49, range=0..100))  # -> DiamondPanels, TriPanels
triangle_srfs = Surface(diamond.DiamondPanels)
debrep = DeconstructBrep(Brep=triangle_srfs)  # -> Faces, Edges, Vertices
area_2 = Area(Geometry=triangle_srfs)  # -> Area, Centroid
pt = Point(debrep.Vertices)
srf_cp = SurfaceClosestPoint(Point=area_2.Centroid, Surface=triangle_srfs)  # -> Point, UVPoint, Distance
image = ImageSampler(
    srf_cp.UVPoint,
    FilePath="C:\Users\Sculpture\Desktop\ScreenShots2019\BlackAndWhiteSharpImageSampler.PNG",
    Filter="Value",
    Interpolate=False,
    Umax=1,
    Umin=0,
    Vmax=1,
    Vmin=0,
    Wrap=1)
evalsrf = EvaluateSurface(Surface=triangle_srfs, Point=srf_cp.UVPoint)  # -> Point, Normal, UDirection, VDirection, Frame
multiplication = Multiplication(A=evalsrf.Normal, B=image)
panel_2 = Panel(image)

pl = PlaneNormal(Origin=Point(0, 0, 0), ZAxis=evalsrf.Normal)

multiplication_2 = Multiplication(A=multiplication, B=Slider(-4, range=-4..10))
move = Move(Geometry=area_2.Centroid, Motion=multiplication_2)  # -> Geometry, Transform
merge = Merge(Data1=pt, Data2=graft(move.Geometry))
del = DelaunayMesh(Points=merge, Plane=graft(pl))

number_slider_2 = Slider(1, range=0..1)
flip = FlipMatrix(Data=flatten(del))
mesh_uv = MeshSurface(Surface=triangle_srfs, UCount=number_slider_2, VCount=number_slider_2, Overhang=True, Equalize=False)
merge_2 = Merge(Data1=flip, Data2=mesh_uv)
wbjoin = WeaverbirdsJoinMeshesAndWeld(Mesh=merge_2, Weld=Toggle(True))

wbcatmullclark = WeaverbirdsCatmullClarkSubdivision(MeshCurves=wbjoin, Level=1, SmoothNakedEdges=1)
