# Grasshopper definition January9tth2020TedeschiChapter6SmoothnessMeshByTriangulation.gh (Grasshopper 1.0.7)
# plug-ins: Bifocals, LunchBox

srf = Surface(reparameterize(<surface referenced from the Rhino model>))
trib = TrianglePanelsB(Surface=srf, UDivisions=Slider(10, range=0..10), VDivisions=Slider(10, range=0..10))
area = Area(Geometry=trib)  # -> Area, Centroid
srf_cp = SurfaceClosestPoint(Point=area.Centroid, Surface=srf)  # -> Point, UVPoint, Distance
evalsrf = EvaluateSurface(Surface=trib, Point=srf_cp.UVPoint)  # -> Point, Normal, UDirection, VDirection, Frame
debrep = DeconstructBrep(Brep=trib)  # -> Faces, Edges, Vertices
move = Move(Geometry=srf_cp.Point, Motion=evalsrf.Normal)  # -> Geometry, Transform
merge = Merge(Data1=graft(move.Geometry), Data2=debrep.Vertices)
pl = PlaneNormal(Origin=evalsrf.Point, ZAxis=evalsrf.Normal)
del = DelaunayMesh(Points=merge, Plane=graft(pl))

# ----
# Mesh by Triangulation
# Delaunay Algorithm
pt = Point([<point referenced from the Rhino model> x6])
del_2 = DelaunayMesh(Points=pt, Plane=PlaneXY(0, 0, 0))
