# Grasshopper definition January9tth2020TedeschiChapter6SmoothnessTriAndQuadMeshConstruction.gh (Grasshopper 1.0.7)
# plug-ins: Bifocals

pt = Point([<point referenced from the Rhino model> x4])
pt_2 = Point([<point referenced from the Rhino model> x4])
triangle = MeshTriangle(
    CornerA=[Slider(0, range=0..100), Slider(2, range=0..100)],
    CornerB=[Slider(1, range=0..1), Slider(1, range=0..1)],
    CornerC=[Slider(2, range=0..10), Slider(3, range=0..10)])
triangle_2 = MeshTriangle(
    CornerA=[Slider(0, range=0..100), Slider(2, range=0..100)],
    CornerB=[Slider(1, range=0..1), Slider(2, range=0..2)],
    CornerC=[Slider(2, range=0..10), Slider(3, range=0..10)])
conmesh = ConstructMesh(Vertices=pt, Faces=triangle)
conmesh_2 = ConstructMesh(Vertices=pt_2, Faces=triangle_2)

# ----
# Repeat for Quad Mesh Node
# 
# Single and Double Mesh Construction
number_slider = Slider(4, range=0..4)
pt_3 = Point([<point referenced from the Rhino model> x5])
triangle_3 = MeshTriangle(
    CornerA=[Slider(0, range=0..100), Slider(2, range=0..100), Slider(3, range=0..10)],
    CornerB=[Slider(1, range=0..1), Slider(1, range=0..2), Slider(1, range=0..10)],
    CornerC=[Slider(2, range=0..10), Slider(3, range=0..10), number_slider])
conmesh_3 = ConstructMesh(Vertices=pt_3, Faces=triangle_3)

# ----
# Creating Meshes by:
# 1. Topology
# 2. Triangulation
# 3. NURBS to Mesh Conversion
number_slider_2 = Slider(1, range=0..1)
pt_4 = Point([<point referenced from the Rhino model> x3])
triangle_4 = MeshTriangle(CornerA=Slider(0, range=0..100), CornerB=number_slider_2, CornerC=Slider(2, range=0..10))
conmesh_4 = ConstructMesh(Vertices=pt_4, Faces=triangle_4)
