# Grasshopper definition January9tth2020TedeschiChapter6SmoothnessVoronoi.gh (Grasshopper 1.0.7)
# plug-ins: Bifocals, Weaverbird

pt = Point([<point referenced from the Rhino model> x14])
voronoi = Voronoi(Points=pt, BruteForceOverride=False)
area = Area(Geometry=voronoi)  # -> Area, Centroid
Z = UnitZ(Factor=Slider(25.08, range=-31..31.01))
disc = Discontinuity(Curve=voronoi, Level=1)  # -> Points, Parameters
move = Move(Geometry=area.Centroid, Motion=Z)  # -> graft(Geometry), Transform
merge = Merge(Data1=disc.Points, Data2=move.Geometry)
xy = XYPlane(Origin=Point(0, 0, 0))
panel = Panel(disc.Points)
del = DelaunayMesh(Points=merge, Plane=xy)
panel_2 = Panel(move.Geometry)
panel_3 = Panel(merge)

# ----
# Voronoi
# Set Points and Rectangle into Grasshopper Nodes
pt_2 = Point([<point referenced from the Rhino model> x14])
xy_2 = XYPlane(Origin=Point(0, 0, 0))
crv = Curve(<curve referenced from the Rhino model>)
voronoi_2 = Voronoi(Points=pt_2, Radius=Slider(11.73, range=0..20), Boundary=crv, Plane=xy_2, BruteForceOverride=False)

# ----
# Non-Planar Voronoi Diagrams
pt_3 = Point([<point referenced from the Rhino model> x98])
crv_2 = Curve(<curve referenced from the Rhino model>)
voronoi_3 = Voronoi(Points=pt_3, Boundary=crv_2, BruteForceOverride=False)
disc_2 = Discontinuity(Curve=voronoi_3, Level=1)  # -> Points, Parameters
devec = DeconstructVector(Vector=disc_2.Points)  # -> XComponent, YComponent, ZComponent
bnd = Bounds(Numbers=flatten(devec.XComponent))
bnd_2 = Bounds(Numbers=flatten(devec.XComponent))
remap = RemapNumbers(Value=devec.XComponent, Source=bnd, Target=Domain(0, 1))  # -> Mapped, Clipped
remap_2 = RemapNumbers(Value=devec.YComponent, Source=bnd_2, Target=Domain(0, 1))  # -> Mapped, Clipped
srf = Surface(reparameterize(<surface referenced from the Rhino model>))
pt_4 = ConstructPoint(XCoordinate=remap.Mapped, YCoordinate=remap_2.Mapped, ZCoordinate=devec.ZComponent)
evalsrf = EvaluateSurface(Surface=srf, Point=pt_4)  # -> Point, Normal, UDirection, VDirection, Frame
pline = PolyLine(Vertices=evalsrf.Point, Closed=True)

# ----
# Mesh Ilands
# Mesh Welding Joins
number_slider = Slider(3, range=0..10)
wbjoin = WeaverbirdsJoinMeshesAndWeld(Mesh=flatten(del), Weld=False)
wbcatmullclark = WeaverbirdsCatmullClarkSubdivision(MeshCurves=wbjoin, Level=number_slider, SmoothNakedEdges=1)
wbcatmullclark_2 = WeaverbirdsCatmullClarkSubdivision(MeshCurves=del, Level=number_slider, SmoothNakedEdges=1)
